# Grasshopper definition 02 Lesson stair.ghx (Grasshopper 1.0.8)
# plug-ins: RhinoCodePluginGH

number_slider = Slider(10, range=0..10)
crv = Curve(<curve referenced from the Rhino model>)
crv_2 = Curve(<curve referenced from the Rhino model>)
divide = DivideCurve(Curve=crv_2, Count=number_slider, Kinks=False)  # -> Points, Tangents, Parameters
divide_2 = DivideCurve(Curve=crv, Count=number_slider, Kinks=False)  # -> Points, Tangents, Parameters
panel = Panel("""0
1""")
dispatch = Dispatch(List=divide.Points, DispatchPattern=panel)  # -> ListA, ListB
dispatch_2 = Dispatch(List=divide_2.Points, DispatchPattern=panel)  # -> ListA, ListB
pt = Point(dispatch.ListA)
pt_2 = Point(dispatch_2.ListB)
ln = Line(StartPoint=divide.Points, EndPoint=divide_2.Points)
weave = Weave(Pattern=panel, Stream0=pt_2, Stream1=pt, NullGaps=False)
py3 = Python3Script(topFlange=crv_2, bottomFlange=crv)  # -> out, a
# ---------- py3: Python ----------
#Defining Variables
string = "Text"
integer = 1
floatNumber = 1.0
array = [0,1,2,3]
dictionary = {"architect":"person who plans, designs, and oversees the construction of buildings."}
complexDictionary = {"a":[0,1,{"b":[4378,3442]}]}
##############comments################
additionResult = integer+floatNumber

print(additionResult)
print(string)

import rhinoscriptsyntax as rs
import ghpythonlib.components as ghc

trussDivision = 10

topPoints = ghc.DivideCurve(topFlange, trussDivision)

print(topPoints)
# ---------- end py3 ----------
pline = PolyLine(Vertices=weave, Closed=False)
