# Grasshopper definition 02 Stairs optimised.ghx (Grasshopper 1.0.7)

steps = Panel("10")
riser = Panel("150")
treader = Panel("250")
series = Series(Start="0", Step=treader, Count=steps)
series_2 = Series(Start="0", Step=riser, Count=steps)
panel = Panel(series_2)
short = ShortestList(ListA=series, ListB=series_2, TrimMode=2)  # -> ListA, ListB
pt = ConstructPoint(XCoordinate=short.ListA, YCoordinate=0, ZCoordinate=short.ListB)
Z = UnitZ(Factor=riser)
move = Move(Geometry=pt, Motion=Z)  # -> Geometry, Transform
panel_2 = Panel("""0
1""")
weave = Weave(Pattern=panel_2, Stream0=pt, Stream1=move.Geometry, NullGaps=False)
order = PointOrder(Points=weave)
points = PointList(Points=weave, Size=Slider(32, range=0..100))
cull_i = CullIndex(List=weave, Indices="-1", Wrap=True)
pline = PolyLine(Vertices=cull_i, Closed=False)
