# Grasshopper definition 02 Steampunk escalator.ghx (Grasshopper 1.0.7)

pt = Point([<point referenced from the Rhino model> x3])
steps = Panel("10")
riser = Panel("150")
addition = Addition()
addition_2 = Addition()
treader = Panel("250")
crv_cp = CurveClosestPoint(Point=pt)  # -> Point, Parameter, Distance
line = LineSDL(Direction="-1,0,0", Length="100000")
ln = Line()
line_2 = LineSDL(Direction="1,0,0", Length="100000")
ln_2 = Line()
division = Division(A=addition, B="2")
division_2 = Division(A=addition_2, B="2")
circle = CircleCNR(Center=pt, Normal="0,-1,0", Radius=crv_cp.Distance)
series = Series(Start="0", Step=treader, Count=steps)
series_2 = Series(Start="0", Step=riser, Count=steps)
handrail_height = Panel("1000")
short = ShortestList(ListA=series, ListB=series_2, TrimMode=2)  # -> ListA, ListB
pt_2 = ConstructPoint(XCoordinate=short.ListA, YCoordinate=0, ZCoordinate=short.ListB)
Z = UnitZ(Factor=handrail_height)
Z_2 = UnitZ(Factor=riser)
move = Move(Geometry=pt_2, Motion=Z)  # -> Geometry, Transform
move_2 = Move(Geometry=pt_2, Motion=Z_2)  # -> Geometry, Transform
panel = Panel("""0
1""")
weave = Weave(Pattern=panel, Stream0=pt_2, Stream1=move_2.Geometry, NullGaps=False)
division_3 = Division(A=handrail_height, B="2")
item = ListItem(List=move_2.Geometry, Index="0", Wrap=True)  # -> Item1, Item
item_2 = ListItem(List=move.Geometry, Index="0", Wrap=True)  # -> Item1, Item
order = PointOrder(Points=weave)
points = PointList(Points=weave, Size=Slider(32, range=0..100))
pline = PolyLine(Vertices=weave, Closed=False)
pline_2 = PolyLine(Vertices=move_2.Geometry, Closed=False)
pline_3 = PolyLine(Vertices=move.Geometry, Closed=False)
X = UnitX(Factor=expr("-x", division_3))
X_2 = UnitX(Factor=division_3)
move_3 = Move(Geometry=item.Item1, Motion=X_2)  # -> Geometry, Transform
move_4 = Move(Geometry=item_2.Item1, Motion=X_2)  # -> Geometry, Transform
move_5 = Move(Geometry=item.Item, Motion=X)  # -> Geometry, Transform
move_6 = Move(Geometry=item_2.Item, Motion=X)  # -> Geometry, Transform
arc = ArcSED(Start=move_3.Geometry, End=move_4.Geometry, Direction="1,0,0")  # -> Arc, Plane, Radius
ln_3 = Line(
    StartPoint=[item.Item1, move_4.Geometry, move_5.Geometry, move_6.Geometry],
    EndPoint=[move_3.Geometry, item_2.Item1, item.Item, item_2.Item])
arc_2 = ArcSED(Start=move_5.Geometry, End=move_6.Geometry, Direction="-1,0,0")  # -> Arc, Plane, Radius
cir = Circle(Plane=arc.Plane, Radius=arc.Radius)
cir_2 = Circle(Plane=arc_2.Plane, Radius=arc_2.Radius)
join = JoinCurves(Curves=[ln_3, arc.Arc, pline_2, pline_3, arc_2.Arc], Preserve=False)
curvepoint = PointOnCurve(cir_2, parameter=0.845)
curvepoint_2 = PointOnCurve(cir, parameter=0.66)
circlett = CircleTanTan(CurveA=join, CurveB=cir_2, Point=curvepoint)
curvepoint_3 = PointOnCurve(cir_2, parameter=0.706)
circlett_2 = CircleTanTan(CurveA=join, CurveB=cir, Point=curvepoint_2)
circlett_3 = CircleTanTan(CurveA=join, CurveB=cir_2, Point=curvepoint_3)
curvepoint_4 = PointOnCurve(circlett_3, parameter=0.448)
circlett_4 = CircleTanTan(CurveA=join, CurveB=circlett_3, Point=curvepoint_4)
