# Grasshopper definition 02 Tutorial stairs.ghx (Grasshopper 1.0.7)

dom = ConstructDomain(DomainStart="2", DomainEnd="11")
range = Range(Domain=dom, Steps=expr("x-1", "5"))
panel = Panel(range)
series = Series(Start="5", Step="5", Count="5")
short = ShortestList(ListA=series, ListB=range, TrimMode=2)  # -> ListA, ListB
item = ListItem(List=range, Index="0", Wrap=True)  # -> Item, Item1
pt = ConstructPoint(XCoordinate=short.ListA, YCoordinate=0, ZCoordinate=short.ListB)
subtraction = Subtraction(A=item.Item1, B=item.Item)
Z = UnitZ(Factor=subtraction)
move = Move(Geometry=pt, Motion=Z)  # -> Geometry, Transform
panel_2 = Panel("""0
1""")
weave = Weave(Pattern=panel_2, Stream0=pt, Stream1=move.Geometry, NullGaps=False)
panel_3 = Panel("""-1
-2""")
order = PointOrder(Points=weave)
points = PointList(Points=weave, Size=Slider(0.591, range=0..10))
cull_i = CullIndex(List=weave, Indices=panel_3, Wrap=True)
pline = PolyLine(Vertices=cull_i, Closed=False)
