# Grasshopper definition 03 Steampunk escalator.ghx (Grasshopper 1.0.7)
# plug-ins: Kangaroo2 Components

# ---- group: gradually increase this until circles are packed
number_slider = Slider(0.671, range=0..2)

number_slider_2 = Slider(0.671, range=0..2)

# ----
steps = Panel("10")
riser = Panel("150")
N = Count(1700)
crv = Curve(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)
mesh = Mesh(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)
N_2 = Count(1700)
crv_2 = Curve(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)
mesh_2 = Mesh(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)
boundary = BoundarySurfaces()
treader = Panel("250")
pop2d = Populate2D(Region={Plane=PlaneXY(3.176457033, 1.369751357, 0), Size=Domain2(u=0..13.69824552, v=0..7.527864653)}, Count=N, Seed=1)
pop2d_2 = Populate2D(Region={Plane=PlaneXY(3.176457033, 1.369751357, 0), Size=Domain2(u=0..13.69824552, v=0..7.527864653)}, Count=N_2, Seed=1)
multiplication = Multiplication(A=Slider(0.02, range=0..1), B=number_slider)
multiplication_2 = Multiplication(A=Slider(0.33, range=0..1), B=number_slider)
popgeo = PopulateGeometry(Geometry=boundary, Count="12", Seed=Slider(6010, range=0..10000))
multiplication_3 = Multiplication(A=Slider(0.02, range=0..1), B=number_slider_2)
multiplication_4 = Multiplication(A=Slider(0.33, range=0..1), B=number_slider_2)
series = Series(Start="0", Step=treader, Count=steps)
series_2 = Series(Start="0", Step=riser, Count=steps)
imgcircles = ImageCircles(Points=pop2d, Mesh=mesh, Min=multiplication, Max=multiplication_2, Curves=crv, Strength=1)
imgcircles_2 = ImageCircles(Points=pop2d_2, Mesh=mesh_2, Min=multiplication_3, Max=multiplication_4, Curves=crv_2, Strength=1)
handrail_height = Panel("1000")
short = ShortestList(ListA=series, ListB=series_2, TrimMode=2)  # -> ListA, ListB
solver = Solver(GoalObjects=imgcircles, Reset=Button(), Threshold=1e-15, Tolerance=0.01, On=Toggle(True))  # -> I, V, O
solver_2 = Solver(GoalObjects=imgcircles_2, Reset=Button(), Threshold=1e-15, Tolerance=0.01, On=Toggle(True))  # -> I, V, O
imgcircles_3 = ImageCircles(Points=popgeo, Min=Slider(120, range=0..1000), Max=Slider(778, range=0..1000), Strength=1)
pt = ConstructPoint(XCoordinate=short.ListA, YCoordinate=0, ZCoordinate=short.ListB)
Z = UnitZ(Factor=handrail_height)
Z_2 = UnitZ(Factor=riser)
cir = Circle(Plane=solver.V, Radius=solver.O)
cir_2 = Circle(Plane=solver_2.V, Radius=solver_2.O)
solver_3 = Solver(GoalObjects=imgcircles_3, Reset=Button(), Threshold=1e-15, Tolerance=0.0001, On=Toggle(True))  # -> I, V, O
move = Move(Geometry=pt, Motion=Z)  # -> Geometry, Transform
move_2 = Move(Geometry=pt, Motion=Z_2)  # -> Geometry, Transform
panel = Panel("""0
1""")
weave = Weave(Pattern=panel, Stream0=pt, Stream1=move_2.Geometry, NullGaps=False)
division = Division(A=handrail_height, B="2")
circle = CircleCNR(Center=solver_3.V, Normal="0,1,0", Radius=solver_3.O)
item = ListItem(List=move_2.Geometry, Index="0", Wrap=True)  # -> Item1, Item
item_2 = ListItem(List=move.Geometry, Index="0", Wrap=True)  # -> Item1, Item
order = PointOrder(Points=weave)
points = PointList(Points=weave, Size=Slider(32, range=0..100))
pline = PolyLine(Vertices=weave, Closed=False)
pline_2 = PolyLine(Vertices=move_2.Geometry, Closed=False)
pline_3 = PolyLine(Vertices=move.Geometry, Closed=False)
X = UnitX(Factor=expr("-x", division))
X_2 = UnitX(Factor=division)
move_3 = Move(Geometry=item.Item1, Motion=X_2)  # -> Geometry, Transform
move_4 = Move(Geometry=item_2.Item1, Motion=X_2)  # -> Geometry, Transform
move_5 = Move(Geometry=item.Item, Motion=X)  # -> Geometry, Transform
move_6 = Move(Geometry=item_2.Item, Motion=X)  # -> Geometry, Transform
arc = ArcSED(Start=move_3.Geometry, End=move_4.Geometry, Direction="1,0,0")  # -> Arc, Plane, Radius
ln = Line(
    StartPoint=[item.Item1, move_4.Geometry, move_5.Geometry, move_6.Geometry],
    EndPoint=[move_3.Geometry, item_2.Item1, item.Item, item_2.Item])
arc_2 = ArcSED(Start=move_5.Geometry, End=move_6.Geometry, Direction="-1,0,0")  # -> Arc, Plane, Radius
arc_3 = ArcSED(Start=move_3.Geometry, End=move_4.Geometry, Direction="-1,0,0")  # -> Arc, Plane, Radius
arc_4 = ArcSED(Start=move_5.Geometry, End=move_6.Geometry, Direction="1,0,0")  # -> Arc, Plane, Radius
join = JoinCurves(Curves=[ln, pline_2, pline_3, arc_3.Arc, arc_4.Arc], Preserve=False)
join_2 = JoinCurves(Curves=[ln, arc.Arc, pline_2, pline_3, arc_2.Arc], Preserve=False)
cir_3 = Circle(Plane=arc.Plane, Radius=arc.Radius)
cir_4 = Circle(Plane=arc_2.Plane, Radius=arc_2.Radius)
boundary_2 = BoundarySurfaces(Edges=join)
triremesh = TriRemesh(Geometry=join, Length=Slider(338, range=0..1000), Iterations=25)  # -> Triangulation, Dual, Creases
substrate = Substrate(
    Border=join,
    Count=Slider(8, range=0..1000),
    Angles=Slider(0, range=0..100),
    Deviation=0,
    Seed=Slider(152, range=0..1000))
popgeo_2 = PopulateGeometry(Geometry=boundary_2, Count="10", Seed=Slider(3398, range=0..10000))
crv_cp = CurveClosestPoint(Point=popgeo_2)  # -> Point, Parameter, Distance
demesh = DeconstructMesh(Mesh=triremesh.Triangulation)  # -> Vertices, Faces, Colours, Normals
medges = MeshEdges(Mesh=triremesh.Triangulation)  # -> NakedEdges, InteriorEdges, NonManifoldEdges
vorgroup = VoronoiGroups(Boundary=join, Generation1=popgeo_2)  # -> Diagram1, Diagram2
mcol = MeshColours(
    Mesh=triremesh.Triangulation,
    Colours=[RGB(127, 255, 0), RGB(0, 100, 0), RGB(34, 139, 34), RGB(124, 252, 0), RGB(154, 205, 50), RGB(173, 255, 47), RGB(50, 205, 50), RGB(152, 251, 152)])
xz = XZPlane(Origin=Point(0, 0, 0))
del = DelaunayMesh(Points=popgeo_2, Plane=xz)
incurve = PointInCurve(Point=demesh.Vertices, Curve=join)  # -> Relationship, Point
tc = TangentCircles(Mesh=del)  # -> Incircles, CirclePacking, Dual
larger = LargerThan(FirstNumber=incurve.Relationship, SecondNumber="2")  # -> LargerThan, OrEqualTo
circle_2 = Circle(tc.CirclePacking)
cull = CullPattern(List=demesh.Vertices, CullPattern=larger.OrEqualTo)
imgcircles_4 = ImageCircles(
    Points=cull,
    Mesh=triremesh.Triangulation,
    Min=Slider(120, range=0..1000),
    Max=Slider(778, range=0..1000),
    Curves=join,
    Strength=1)
solver_4 = Solver(GoalObjects=imgcircles_4, Reset=Button(), Threshold=1e-15, Tolerance=0.0001, On=Toggle(True))  # -> I, V, O
circle_3 = CircleCNR(Center=solver_4.V, Normal="0,1,0", Radius=solver_4.O)
