# Grasshopper definition 03 Tutorial curvy stair.ghx (Grasshopper 1.0.8)
# plug-ins: Pufferfish

md_slider = MDSlider(SliderMode=0, slider_value=Point(0, 0, 0.5), x_domain=Domain(0, 1), y_domain=Domain(0, 1), z_domain=Domain(0, 1))
panel = Panel(md_slider)
dom = ConstructDomain(DomainStart="2", DomainEnd="11")
dom_2 = ConstructDomain(DomainStart="2", DomainEnd="11")
range = Range(Domain=dom, Steps=expr("x-1", "10"))
panel_2 = Panel(range)
series = Series(Start="5", Step="5", Count="10")
range_2 = Range(Domain=dom_2, Steps=expr("x-1", "10"))
panel_3 = Panel(range_2)
series_2 = Series(Start="5", Step="5", Count="10")
map_srf = MapToSurface()
short = ShortestList(ListA=series, ListB=range, TrimMode=2)  # -> ListA, ListB
short_2 = ShortestList(ListA=series_2, ListB=range_2, TrimMode=2)  # -> ListA, ListB
item = ListItem(List=range, Index="0", Wrap=True)  # -> Item, Item1
item_2 = ListItem(List=range_2, Index="0", Wrap=True)  # -> Item, Item1
pt = ConstructPoint(XCoordinate=short.ListA, YCoordinate=short.ListB, ZCoordinate=0)
subtraction = Subtraction(A=item.Item1, B=item.Item)
mappt2srf = MapPointToSurface()
pt_2 = ConstructPoint(XCoordinate=short_2.ListA, YCoordinate=short_2.ListB, ZCoordinate=0)
subtraction_2 = Subtraction(A=item_2.Item1, B=item_2.Item)
Y = UnitY(Factor=subtraction)
Y_2 = UnitY(Factor=subtraction_2)
move = Move(Geometry=pt, Motion=Y)  # -> Geometry, Transform
panel_4 = Panel("""0
1""")
move_2 = Move(Geometry=pt_2, Motion=Y_2)  # -> Geometry, Transform
panel_5 = Panel("""0
1""")
weave = Weave(Pattern=panel_4, Stream0=pt, Stream1=move.Geometry, NullGaps=False)
weave_2 = Weave(Pattern=panel_5, Stream0=pt_2, Stream1=move_2.Geometry, NullGaps=False)
panel_6 = Panel("""-1
-2""")
panel_7 = Panel("""-1
-2""")
order = PointOrder(Points=weave)
points = PointList(Points=weave, Size=Slider(0.591, range=0..10))
cull_i = CullIndex(List=weave, Indices=panel_6, Wrap=True)
order_2 = PointOrder(Points=weave_2)
points_2 = PointList(Points=weave_2, Size=Slider(0.591, range=0..10))
cull_i_2 = CullIndex(List=weave_2, Indices=panel_7, Wrap=True)
bbox = BoundingBox(Content=cull_i, Plane=PlaneXY(0, 0, 0), UnionBox=True)  # -> Box, Box_2
pline = PolyLine(Vertices=cull_i, Closed=False)
bbox_2 = BoundingBox(Content=cull_i_2, Plane=PlaneXY(0, 0, 0), UnionBox=True)  # -> Box, Box_2
pline_2 = PolyLine(Vertices=cull_i_2, Closed=False)
debox = DeconstructBox(Box=bbox.Box)  # -> Plane, X, Y, Z
Z = UnitZ(Factor="11")
debox_2 = DeconstructBox(Box=bbox_2.Box)  # -> Plane, X, Y, Z
crv = Curve(<curve referenced from the Rhino model>)
crv_2 = Curve(<curve referenced from the Rhino model>)
Z_2 = UnitZ(Factor="11")
crv_3 = Curve(<curve referenced from the Rhino model>)
crv_4 = Curve(<curve referenced from the Rhino model>)
planesrf = PlaneSurface(Plane=debox.Plane, XSize=debox.X, YSize=debox.Y)
srf = Surface(planesrf)
srf_cp = SurfaceClosestPoint(Point=cull_i, Surface=reparameterize(srf))  # -> Point, UVPoint, Distance
planesrf_2 = PlaneSurface(Plane=debox_2.Plane, XSize=debox_2.X, YSize=debox_2.Y)
srf_2 = Surface(planesrf_2)
srf_cp_2 = SurfaceClosestPoint(Point=cull_i_2, Surface=reparameterize(srf_2))  # -> Point, UVPoint, Distance
extr = Extrude(Base=crv, Direction=Z)
extr_2 = Extrude(Base=crv_2, Direction=Z)
extr_3 = Extrude(Base=crv_3, Direction=Z_2)
extr_4 = Extrude(Base=crv_4, Direction=Z_2)
pdecon = Deconstruct(Point=srf_cp.UVPoint)  # -> XComponent, YComponent, ZComponent
panel_8 = Panel(srf_cp.UVPoint)
pdecon_2 = Deconstruct(Point=srf_cp_2.UVPoint)  # -> XComponent, YComponent, ZComponent
panel_9 = Panel(srf_cp_2.UVPoint)
pt_3 = ConstructPoint(XCoordinate=pdecon.YComponent, YCoordinate=pdecon.XComponent, ZCoordinate=0)
pt_4 = ConstructPoint(XCoordinate=pdecon_2.YComponent, YCoordinate=pdecon_2.XComponent, ZCoordinate=0)
evalsrf = EvaluateSurface(Surface=reparameterize(extr), Point=pt_3)  # -> Point, Normal, UDirection, VDirection, Frame
evalsrf_2 = EvaluateSurface(Surface=reparameterize(extr_2), Point=pt_3)  # -> Point, Normal, UDirection, VDirection, Frame
evalsrf_3 = EvaluateSurface(Surface=reparameterize(extr_4), Point=pt_4)  # -> Point, Normal, UDirection, VDirection, Frame
pline_3 = PolyLine(Vertices=evalsrf_2.Point, Closed=False)
pline_4 = PolyLine(Vertices=evalsrf.Point, Closed=False)
pline_5 = PolyLine(Vertices=evalsrf_3.Point, Closed=False)
pull = PullCurve(Curve=pline_5, Surface=extr_3)
pull_2 = PullCurve(Curve=pline_3, Surface=extr_2)
pull_3 = PullCurve(Curve=pline_4, Surface=extr)
loft = Loft(Curves=[pull, pline_5], Options={Adjust=False, Closed=False, LoftEnds=0, LoftSimp=0, LoftType=0, Rebuild=10, Refit=0.01})
loft_2 = Loft(
    Curves=[pull_3, pull_2],
    Options={Adjust=False, Closed=False, LoftEnds=0, LoftSimp=0, LoftType=0, Rebuild=10, Refit=0.01})
