# Grasshopper definition 03 Tutorial spiral stair.ghx (Grasshopper 1.0.8)

number_slider = Slider(0.25, range=0..1)
number_slider_2 = Slider(0.25, range=0..1)
number_slider_3 = Slider(1363, range=0..5000)
number_slider_4 = Slider(1363, range=0..5000)
pt = ConstructPoint(XCoordinate=0, YCoordinate=0, ZCoordinate=0)
dom = ConstructDomain(DomainStart=Slider(0, range=0..1), DomainEnd=number_slider_3)
dom_2 = ConstructDomain(DomainStart=Slider(0, range=0..1), DomainEnd=number_slider_4)
division = Division(A=number_slider_3, B=Slider(20, range=0..20))
division_2 = Division(A=number_slider_4, B=Slider(20, range=0..20))
pt_2 = ConstructPoint(XCoordinate=number_slider, YCoordinate=0, ZCoordinate=0)
X = UnitX(Factor=1)
circle = CircleCNR(Center=pt, Normal=Vector(0, 0, 1), Radius=number_slider)
addition = Addition(A=number_slider, B=number_slider_2)
range = Range(Domain=dom, Steps=division)
pt_3 = ConstructPoint(XCoordinate=Slider(1278, range=0..5000), YCoordinate=0, ZCoordinate=0)
range_2 = Range(Domain=dom_2, Steps=division_2)
pt_4 = ConstructPoint(XCoordinate=Slider(1278, range=0..5000), YCoordinate=0, ZCoordinate=0)
circle_2 = CircleCNR(Center=pt, Normal=Vector(0, 0, 1), Radius=addition)
line = LineSDL(Start=pt_2, Direction=X, Length=number_slider_2)
rotate = Rotate(Geometry=pt_3, Angle=degrees(range), Plane=PlaneXY(0, 0, 0))  # -> Geometry, Transform
rotate_2 = Rotate(Geometry=pt_4, Angle=degrees(range_2), Plane=PlaneXY(0, 0, 0))  # -> Geometry, Transform
panel = Panel(range)
panel_2 = Panel(range_2)
pt_5 = ConstructPoint(XCoordinate=0, YCoordinate=0, ZCoordinate=0)
Z = UnitZ(Factor=1)
rad = Radians(Degrees=Slider(0, range=0..360))
rad_2 = Radians(Degrees=Slider(242, range=0..360))
Z_2 = UnitZ(Factor=range_2)
line_2 = LineSDL(Start=pt_5, Direction=Z, Length=1)
move = Move(Geometry=rotate_2.Geometry, Motion=Z_2)  # -> Geometry, Transform
dom_3 = ConstructDomain(DomainStart=rad, DomainEnd=rad_2)
revsrf = Revolution(Curve=line, Axis=line_2, Domain=dom_3)
intcrv = Interpolate(Vertices=rotate.Geometry, Degree=3, Periodic=False, KnotStyle=1)  # -> Curve, Length, Domain
intcrv_2 = Interpolate(Vertices=move.Geometry, Degree=3, Periodic=False, KnotStyle=1)  # -> Curve, Length, Domain
repeat = RepeatData(Data="300", Length="10")
merge = Merge(Data1=flatten(repeat), Data2=flatten("1000"))
len = Length(Curve=intcrv.Curve)
repeat_2 = RepeatData(Data=merge, Length=Slider(36, range=0..100))
ma = MassAddition(Input=repeat_2)  # -> Result, PartialResults
panel_3 = Panel(ma.PartialResults)
division_3 = Division(A=ma.PartialResults, B=len)
shatter = Shatter(Curve=reparameterize(intcrv.Curve), Parameters=division_3)
cull_i = CullIndex(List=shatter, Indices="-1", Wrap=True)
scale = Scale(Geometry=cull_i, Center=Point(0, 0, 0), Factor=Slider(1.81, range=0..3))  # -> Geometry, Transform
rulesrf = RuledSurface(CurveA=cull_i, CurveB=scale.Geometry)
lng = ListLength(List=rulesrf)
series = Series(Start="150", Step="150", Count=lng)
geo = Geometry([<extrusion referenced from the Rhino model> x3])
Z_3 = UnitZ(Factor=series)
move_2 = Move(Geometry=cull_i, Motion=Z_3)  # -> Geometry, Transform
panel_4 = Panel(series)
group = Group(Objects=geo)
crv = Curve(move_2.Geometry)
hframe = HorizontalFrame(Curve=reparameterize(crv), Parameter="0,5")
xy = XYPlane(Origin=Point(0, 0, 0))
move_3 = Move(Geometry=rulesrf, Motion=Z_3)  # -> Geometry, Transform
panel_5 = Panel("""0
0
0
0
0
0
0
0
0
0
1""")
dispatch = Dispatch(List=hframe, DispatchPattern=panel_5)  # -> ListA, ListB
bbox = BoundingBox(Content=group, Plane=PlaneXY(0, 0, 0))  # -> Box, Box_2
orient = Orient(Geometry=group, Source=xy, Target=dispatch.ListB)  # -> Geometry, Transform
sbox = SurfaceBox(Surface=move_3.Geometry, Domain=move_3.Geometry, Height=Slider(300, range=0..1000))
morph = BoxMorph(Geometry=group, Reference=bbox.Box, Target=sbox)
