# Grasshopper definition 04 Atompunk stair.ghx (Grasshopper 1.0.8)
# plug-ins: Pufferfish

series = Series(Start="0", Step="0", Count="2")
series_2 = Series(Start="0", Step="1200", Count="2")
pt = ConstructPoint(XCoordinate=series_2, YCoordinate=0, ZCoordinate=series)
Z = UnitZ(Factor="1200")
move = Move(Geometry=pt, Motion=Z)  # -> Geometry, Transform
panel = Panel("""1
0
0
1""")
weave = Weave(Pattern=panel, Stream0=pt, Stream1=move.Geometry, NullGaps=False)
pline = PolyLine(Vertices=weave, Closed=False)
division = Division(A="1200", B=Slider(2.295, range=2..15))
fillet = FilletDistance(Curve=pline, Distance=division)
crv = Curve(<curve referenced from the Rhino model>)
arrcurve = CurveArray(Geometry=fillet, Curve=crv, Count=Slider(12, range=1..100))  # -> Geometry, Transform
loft = Loft(
    Curves=arrcurve.Geometry,
    Options={Adjust=False, Closed=False, LoftEnds=0, LoftSimp=0, LoftType=0, Rebuild=10, Refit=0.01})
offsrf = OffsetSurface(Surface=loft, Distance=Slider(18, range=0..300), BothSides=0, CreateSolid=True)
splitmul = SplitBrepMultiple(Brep=offsrf)
