# Grasshopper definition 04 Steampunk escalator.ghx (Grasshopper 1.0.8)
# plug-ins: RhinoCodePluginGH, Kangaroo2 Components

steps = Panel("10")
riser = Panel("150")
treader = Panel("250")
series = Series(Start="0", Step=treader, Count=steps)
series_2 = Series(Start="0", Step=riser, Count=steps)
handrail_height = Panel("1000")
short = ShortestList(ListA=series, ListB=series_2, TrimMode=2)  # -> ListA, ListB
pt = ConstructPoint(XCoordinate=short.ListA, YCoordinate=0, ZCoordinate=short.ListB)
Z = UnitZ(Factor=handrail_height)
Z_2 = UnitZ(Factor=riser)
move = Move(Geometry=pt, Motion=Z)  # -> Geometry, Transform
move_2 = Move(Geometry=pt, Motion=Z_2)  # -> Geometry, Transform
panel = Panel("""0
1""")
weave = Weave(Pattern=panel, Stream0=pt, Stream1=move_2.Geometry, NullGaps=False)
division = Division(A=handrail_height, B="2")
item = ListItem(List=move_2.Geometry, Index="0", Wrap=True)  # -> Item1, Item
item_2 = ListItem(List=move.Geometry, Index="0", Wrap=True)  # -> Item1, Item
order = PointOrder(Points=weave)
points = PointList(Points=weave, Size=Slider(32, range=0..100))
pline = PolyLine(Vertices=weave, Closed=False)
pline_2 = PolyLine(Vertices=move_2.Geometry, Closed=False)
pline_3 = PolyLine(Vertices=move.Geometry, Closed=False)
X = UnitX(Factor=expr("-x", division))
X_2 = UnitX(Factor=division)
move_3 = Move(Geometry=item.Item1, Motion=X_2)  # -> Geometry, Transform
move_4 = Move(Geometry=item_2.Item1, Motion=X_2)  # -> Geometry, Transform
move_5 = Move(Geometry=item.Item, Motion=X)  # -> Geometry, Transform
move_6 = Move(Geometry=item_2.Item, Motion=X)  # -> Geometry, Transform
arc = ArcSED(Start=move_3.Geometry, End=move_4.Geometry, Direction="1,0,0")  # -> Arc, Plane, Radius
ln = Line(
    StartPoint=[item.Item1, move_4.Geometry, move_5.Geometry, move_6.Geometry],
    EndPoint=[move_3.Geometry, item_2.Item1, item.Item, item_2.Item])
arc_2 = ArcSED(Start=move_5.Geometry, End=move_6.Geometry, Direction="-1,0,0")  # -> Arc, Plane, Radius
arc_3 = ArcSED(Start=move_3.Geometry, End=move_4.Geometry, Direction="-1,0,0")  # -> Arc, Plane, Radius
arc_4 = ArcSED(Start=move_5.Geometry, End=move_6.Geometry, Direction="1,0,0")  # -> Arc, Plane, Radius
join = JoinCurves(Curves=[ln, pline_2, pline_3, arc_3.Arc, arc_4.Arc], Preserve=False)
join_2 = JoinCurves(Curves=[ln, arc.Arc, pline_2, pline_3, arc_2.Arc], Preserve=False)
cir = Circle(Plane=arc.Plane, Radius=arc.Radius)
# If you want to control the number of points, we need to use something like this.
cir_2 = Circle(Plane=arc_2.Plane, Radius=arc_2.Radius)
boundary = BoundarySurfaces(Edges=join)
triremesh = TriRemesh(Geometry=join, Length=Slider(338, range=0..1000), Iterations=25)  # -> Triangulation, Dual, Creases
substrate = Substrate(
    Border=join,
    Count=Slider(8, range=0..1000),
    Angles=Slider(0, range=0..100),
    Deviation=0,
    Seed=Slider(152, range=0..1000))
popgeo = PopulateGeometry(Geometry=boundary, Count="10", Seed=Slider(3398, range=0..10000))
crv_cp = CurveClosestPoint(Point=popgeo)  # -> Point, Parameter, Distance
demesh = DeconstructMesh(Mesh=triremesh.Triangulation)  # -> Vertices, Faces, Colours, Normals
medges = MeshEdges(Mesh=triremesh.Triangulation)  # -> NakedEdges, InteriorEdges, NonManifoldEdges
vorgroup = VoronoiGroups(Boundary=join, Generation1=popgeo)  # -> Diagram1, Diagram2
mcol = MeshColours(
    Mesh=triremesh.Triangulation,
    Colours=[RGB(127, 255, 0), RGB(0, 100, 0), RGB(34, 139, 34), RGB(124, 252, 0), RGB(154, 205, 50), RGB(173, 255, 47), RGB(50, 205, 50), RGB(152, 251, 152)])
xz = XZPlane(Origin=Point(0, 0, 0))

min_radius = Slider(233, range=0..500)
max_radius = Slider(1000, range=0..1000)
# If you want to change the number of circles,  first change the number, then set the min radius to 0, then hit the reset button.
# Slowly drag up the "Min Radius" until you are happy.
number_of_circles = Slider(7, range=0..100)

offset = OffsetCurve(Curve=join, Distance=-100, Corners=1)
boundary_2 = BoundarySurfaces(Edges=offset)
popgeo_2 = PopulateGeometry(Geometry=boundary_2, Count=number_of_circles, Seed=1)
show = Show(G=popgeo_2)

incurve = PointInCurve(Point=demesh.Vertices, Curve=join)  # -> Relationship, Point
del = DelaunayMesh(Points=popgeo, Plane=xz)
tc = TangentCircles(Mesh=del)  # -> Incircles, CirclePacking, Dual
larger = LargerThan(FirstNumber=incurve.Relationship, SecondNumber="2")  # -> LargerThan, OrEqualTo
circle = Circle(tc.CirclePacking)
# Need this input for Kangaroo if we use random generated points.
cull = CullPattern(List=demesh.Vertices, CullPattern=larger.OrEqualTo)
imgcircles = ImageCircles(Points=popgeo_2, Mesh=triremesh.Triangulation, Min=min_radius, Max=max_radius, Curves=join, Strength=1)
solver = Solver(GoalObjects=flatten([imgcircles, show]), Reset=Button(), Threshold=1e-15, Tolerance=0.0001, On=Toggle(True))  # -> I, V, O

# ----
# Some of the outputs aren't numbers. This section checks the type of the object and returns that. We check for floats (which means decimal numbers) and use those to control the circles.
panel_2 = Panel("float")
ipy2 = IronPython2Script(x=solver.O)  # -> a
# ---------- ipy2: IronPython ----------
a = type(x).__name__
# ---------- end ipy2 ----------
expression = Expression(x=ipy2, y=panel_2, Expression="x=y")
dispatch = Dispatch(List=solver.O, DispatchPattern=expression)  # -> ListA, ListB

circle_2 = CircleCNR(Center=solver.V, Normal="0,1,0", Radius=dispatch.ListA)
