# Grasshopper definition 04 Tick Tock Clock Stairs.ghx (Grasshopper 1.0.8)

number_slider = Slider(3000, range=0..10000)
dom = ConstructDomain(DomainStart="700", DomainEnd="5000")
crv = Curve(<curve referenced from the Rhino model>)
cir = Circle(Plane=PlaneXY(0, 0, 0), Radius="500")
random = Random(Range=dom, Number="5", Seed=2)
curvepoint = PointOnCurve(crv, parameter=0.119)
crv_2 = Curve(<curve referenced from the Rhino model>)
divlength = DivideLength(Curve=crv, Length=number_slider)  # -> Points, Tangents, Parameters
divlength_2 = DivideLength(Curve=crv_2, Length=random)  # -> Points, Tangents, Parameters
crv_cp = CurveClosestPoint(Point=curvepoint, Curve=cir)  # -> Point, Parameter, Distance
division = Division(A=number_slider, B=2)
curvepoint_2 = PointOnCurve(crv, parameter=0.282)
cir_2 = Circle(Plane=divlength.Points, Radius=division)
cir_3 = Circle(Plane=curvepoint, Radius=crv_cp.Distance)
circle = Circle3Pt()  # -> Circle, Plane, Radius
crv_cp_2 = CurveClosestPoint(Point=curvepoint_2, Curve=cir_3)  # -> Point, Parameter, Distance
curvepoint_3 = PointOnCurve(crv, parameter=0.466)
cir_4 = Circle(Plane=curvepoint_2, Radius=crv_cp_2.Distance)
crv_cp_3 = CurveClosestPoint(Point=curvepoint_3, Curve=cir_4)  # -> Point, Parameter, Distance
curvepoint_4 = PointOnCurve(crv, parameter=0.601)
cir_5 = Circle(Plane=curvepoint_3, Radius=crv_cp_3.Distance)
crv_cp_4 = CurveClosestPoint(Point=curvepoint_4, Curve=cir_5)  # -> Point, Parameter, Distance
cir_6 = Circle(Plane=curvepoint_4, Radius=crv_cp_4.Distance)
offset = OffsetCurve(Curve=cir_6, Distance="100", Corners=1)
offset_2 = OffsetCurve(Curve=cir_5, Distance="-100", Corners=1)
divlength_3 = DivideLength(Curve=cir_6, Length="100")  # -> Points, Tangents, Parameters
divlength_4 = DivideLength(Curve=cir_5, Length="100")  # -> Points, Tangents, Parameters
panel = Panel("""0
1
1
0""")
crv_cp_5 = CurveClosestPoint(Point=divlength_3.Points, Curve=offset)  # -> Point, Parameter, Distance
panel_2 = Panel("""0
1
1
0""")
crv_cp_6 = CurveClosestPoint(Point=divlength_4.Points, Curve=offset_2)  # -> Point, Parameter, Distance
weave = Weave(Pattern=panel, Stream0=divlength_3.Points, Stream1=crv_cp_5.Point, NullGaps=False)
weave_2 = Weave(Pattern=panel_2, Stream0=divlength_4.Points, Stream1=crv_cp_6.Point, NullGaps=False)
pline = PolyLine(Vertices=weave, Closed=invert(False))
pline_2 = PolyLine(Vertices=weave_2, Closed=invert(False))
