# Grasshopper definition 05 Dome.gh (Grasshopper 1.0.8)
# plug-ins: Kangaroo2 Components

number_slider = Slider(4700, range=3000..5000)
xy = XYPlane(Origin=Point(0, 0, 0))
sph = Sphere(Base=xy, Radius=number_slider)
cir = Circle(Plane=xy, Radius=number_slider)
srfsplit = SurfaceSplit(Surface=sph, Curves=cir)
item = ListItem(List=srfsplit, Index="0", Wrap=True)
triremesh = TriRemesh(Geometry=item, Iterations=25)  # -> Triangulation, Dual, Creases
medges = MeshEdges(Mesh=triremesh.Triangulation)  # -> NakedEdges, InteriorEdges, NonManifoldEdges
pipe = Pipe(Curve=medges.InteriorEdges, Radius=Slider(15, range=1..50), Caps=0)
