# Grasshopper definition 05 Tutorial facade.ghx (Grasshopper 1.0.8)

trigrid = Triangular(Plane=PlaneXY(0, 0, 0), Size=1, ExtentX=Slider(15, range=0..20), ExtentY=Slider(15, range=0..20))  # -> Cells, Points
flatten = FlattenTree(Tree=trigrid.Cells, Path="{0}")
panel = Panel("""0
1""")
pt = Point([<point referenced from the Rhino model> x2])
item = ListItem(List=flatten, Index=panel, Wrap=True)
explode = Explode(Curve=flatten, Recursive=True)  # -> Segments, Vertices
area = Area(Geometry=flatten)  # -> Area, Centroid
eval = EvaluateLength(Curve=reparameterize(explode.Segments), Length="0.5", Normalized=True)  # -> Point, Tangent, Parameter
graft = GraftTree(Tree=area.Centroid, IncludeEmptyLists=True, IncludeNullItems=True)
dist = Distance(PointA=graft, PointB=pt)
flatten_2 = FlattenTree(Tree=dist, Path="{0}")
dom = ConstructDomain(DomainStart=Slider(0, range=0..1), DomainEnd=Slider(4.593, range=0..10))
dom_2 = ConstructDomain(DomainStart=Slider(1, range=0..1), DomainEnd=Slider(0, range=0..1))
dom_3 = ConstructDomain(DomainStart=Slider(0, range=0..1), DomainEnd=Slider(0.945, range=0..1))
bnd = Bounds(Numbers=flatten_2)
number_slider = Slider(0.483, range=0..1)
ln = Line(StartPoint=eval.Point, EndPoint=graft)
remap = RemapNumbers(Value=dist, Source=dom, Target=dom_2)  # -> Mapped, Clipped
remap_2 = RemapNumbers(Value=dist, Source=bnd, Target=dom_3)  # -> Mapped, Clipped
bool = Boolean(remap.Clipped)
pt_2 = Point(explode.Vertices)
dispatch = Dispatch(List=remap.Clipped, DispatchPattern=bool)  # -> ListA, ListB
sort = SortList(Keys=dispatch.ListA)  # -> reverse(Keys), ValuesA
avr = Average(Input=dispatch.ListA)
int = Integer(0)
item_2 = ListItem(List=sort.Keys, Index=0, Wrap=True)
Z = UnitZ(Factor=Slider(0.169, range=0..1))
nullrep = ReplaceNulls(Items=item_2, Replacements=int)  # -> Items, Count
move = Move(Geometry=graft, Motion=Z)  # -> Geometry, Transform
remap_3 = RemapNumbers(Value=nullrep.Items, Source=Domain(0, 1), Target=dom_3)  # -> Mapped, Clipped
item_3 = ListItem(List=remap_3.Mapped, Index=0, Wrap=True)
panel_2 = Panel(nullrep.Items)
graph = GraphMapper(item_3, x0=0, x1=1, y0=0, y1=1, container_name="Sine", Equation_px=[0, 0.4952114224], Equation_py=[0, 0.8401683569])
eval_2 = EvaluateLength(Curve=reparameterize(ln), Length=graph, Normalized=True)  # -> Point, Tangent, Parameter
weave = Weave(Pattern=[0, 1], Stream0=pt_2, Stream1=eval_2.Point, NullGaps=False)
pline = PolyLine(Vertices=weave, Closed=False)
extr = ExtrudePoint(Base=pline, Point=move.Geometry)
