# Grasshopper definition 07 Tutorial delaunay mesh.ghx (Grasshopper 1.0.8)
# plug-ins: Human

dpipeline = DynamicGeometryPipeline(
    LayerFilter="Default",
    TypeFilter="Point",
    NameFilter="*",
    GroupByLayer=False,
    GroupByType=False,
    IncludeHidden=True,
    IncludeLocked=True,
    enableFullPath=False,
    listenToAttributes=True)
del = DelaunayMesh(Points=dpipeline, Plane=PlaneXY(0, 0, 0))
