# Grasshopper definition 07 Tutorial kangaroo.ghx (Grasshopper 1.0.8)
# plug-ins: Kangaroo2 Components

mplane = MeshPlane(Boundary={Plane=PlaneXY(0, 0, 0), Size=Domain2(u=-10..10, v=-10..10)}, WidthCount=10, HeightCount=10)  # -> Mesh, Area
demesh = DeconstructMesh(Mesh=mplane.Mesh)  # -> Vertices, Faces, Colours, Normals
edgelengths = EdgeLengths(Mesh=mplane.Mesh, LengthFactor=Slider(0.316, range=0..1), Strength=1)
pt = Point([<point referenced from the Rhino model> x4])
pressure = Pressure(M=mplane.Mesh, Strength=1)
load = Load(Point=demesh.Vertices, ForceVector=Vector(0, 0, 1), Weighting=1)
cp = ClosestPoint(Point=pt, Cloud=demesh.Vertices)  # -> ClosestPoint, CPIndex, Distance
anchor = Anchor(Point=cp.ClosestPoint, Strength=10000)
nv = NakedVertices()  # -> ClothedIndex, NakedIndex, ClothedPts, NakedPts
merge = Merge(Data1=anchor, Data2=edgelengths, Data3=pressure)
stepsolver = StepSolver(
    GoalObjects=flatten(merge),
    Tolerance=0.0001,
    Momentum=False,
    Damping=0.99,
    SubIterations="1",
    Animate=Slider(15, range=0..100))  # -> I, V, O
