# Grasshopper definition 08 Tutorial image.ghx (Grasshopper 1.0.8)
# plug-ins: Redback-Beta.GH

srf = Surface(<surface referenced from the Rhino model>)
pt = ConstructPoint(XCoordinate=0, YCoordinate=0, ZCoordinate=0)
evalsrf = EvaluateSurface(Surface=srf, Point=pt)  # -> Point, Normal, UDirection, VDirection, Frame
bbox = BoundingBox(Content=srf, Plane=evalsrf.Frame)  # -> Box, Box_2
xy = XYPlane(Origin=Point(0, 0, 0))
debox = DeconstructBox(Box=bbox.Box)  # -> Plane, X, Y, Z
panel = Panel("C:\Users\lyxu2675\Downloads\Screenshot 2024-09-16 120312.png")
svg_layout = SVGLayout(Plane=xy, Dimensions="A3 (L)", Scale="1:500", Location=Toggle(True))  # -> L, R
rectangle = Rectangle(Plane=debox.Plane, XSize=debox.X, YSize=debox.Y, Radius=0)  # -> Rectangle, Length
image_object = ImageObject(RE=rectangle.Rectangle, ImagePath=panel)
geo2arch = Geo2Arch(Geometry=image_object, Properties="{}")
svg = SVGGenerator(JO=geo2arch, LA=svg_layout.L)
rel_path = RelativePath(Path=Toggle(False), RelativePath="svgOutput\imageDemo.svg")  # -> FullPath, Directory, FileName
write = WriteFile(Run=Toggle(True), Content=svg, FileDirectory=rel_path.Directory, FileName=rel_path.FileName)
