# Grasshopper definition 08 Tutorial redback.ghx (Grasshopper 1.0.8)
# plug-ins: Redback-Beta.GH

# Layer reference alternatives:
# Dynamic Geometry Pipeline - Human
# Reference by Layer (R6) - Elephant
panel = Panel("""Default
Layer 01
Layer 02""")
viewports = QueryViewports(AutoUpdateState=True)
cyl = Cylinder(Base=PlaneXY(0, 0, 0), Radius=0.5, Length=1)
objects = QueryModelObjects(Layer=panel, Locked=True, Hidden=True, AutoUpdateState=True)
scale = Scale(Geometry=cyl, Center=Point(0, 0, 0), Factor=Slider(100, range=1..100))  # -> Geometry, Transform
item = ListItem(List=viewports, Index=0, Wrap=True)
view = View(<view referenced from the Rhino model>, ViewSource=1)
clean = CleanTree(RemoveNulls=True, RemoveInvalid=True, RemoveEmpty=Toggle(False), Tree=objects)
object = ModelObject(Object=clean)  # -> Object, Geometry, Layer
make2d = Make2D(Geometry=scale.Geometry, View=view, TangentEdges=False, TangentSeams=False, AutoComputeMake2D=False)  # -> VisibleCurves, VisibleIndex, VisibleType, HiddenCurves, HiddenIndex, HiddenType
# https://css-tricks.com/svg-properties-and-css/
# 
# https://developer.mozilla.org/en-US/docs/Web/SVG
panel_2 = Panel("""*{
fill: none;
stroke: #ff0000;
stroke-width: 0.12mm;
stroke-linecap: round;
stroke-linejoin: round;
}
[layer="Layer 01"]{
stroke-width: 0.2mm;
stroke-dasharray: 0.5mm 0.5mm;
}
[layer="Layer 02"]{
stroke-width:0.25mm;
stroke-dasharray: 0.5mm 0.5mm;
}""")
layer = ModelLayer(Layer=object.Layer)  # -> Layer, Name
graft = GraftTree(Tree=layer.Name, IncludeEmptyLists=True, IncludeNullItems=True)
crv = Curve(object.Geometry)
xy = XYPlane(Origin=Point(0, 0, 0))
json = CreateJSON(Keys="layer", Values=graft)
geo2arch = Geo2Arch(Geometry=flatten(make2d.VisibleCurves), Properties=flatten("{}"))
geo2arch_2 = Geo2Arch(Geometry=flatten(crv), Properties=flatten(json))
svg_layout = SVGLayout(Plane=xy, Dimensions="A4 (L)", Scale="1:50", Location=Toggle(True))  # -> L, R
rel_path = RelativePath(Path=Toggle(True), RelativePath="svgOutput\svgdemo.svg")  # -> FullPath, Directory, FileName
rel_path_2 = RelativePath(Path=Toggle(True), RelativePath="svgOutput\make2Ddemo.svg")  # -> FullPath, Directory, FileName
svg = SVGGenerator(JO=geo2arch_2, LA=svg_layout.L, CSS=panel_2)
svg_2 = SVGGenerator(JO=geo2arch, LA=svg_layout.L)
write = WriteFile(Run=Toggle(True), Content=svg, FileDirectory=rel_path.Directory, FileName=rel_path.FileName)
write_2 = WriteFile(Run=Toggle(True), Content=svg_2, FileDirectory=rel_path_2.Directory, FileName=rel_path_2.FileName)
panel_3 = Panel(write)
# Layer reference alternatives:
# Dynamic Geometry Pipeline - Human
# Reference by Layer (R6) - Elephant
panel_4 = Panel("""Default
Layer 01
Layer 02""")
objects_2 = QueryModelObjects(Layer=panel_4, Locked=True, Hidden=True, AutoUpdateState=True)
clean_2 = CleanTree(RemoveNulls=True, RemoveInvalid=True, RemoveEmpty=Toggle(False), Tree=objects_2)
object_2 = ModelObject(Object=clean_2)  # -> Object, Geometry, Layer
panel_5 = Panel("""*{
fill: none;
stroke: #ff0000;
stroke-width: 0.12mm;
stroke-linecap: round;
stroke-linejoin: round;
}
[layer="Layer 01"]{
stroke-width: 0.09mm;
stroke-dasharray: 0.5mm 0.5mm;
}
[layer="Layer 02"]{
stroke-width:0.2mm;
stroke-dasharray: 0.5mm 0.5mm;
}""")
layer_2 = ModelLayer(Layer=object_2.Layer)  # -> Layer, Name
xy_2 = XYPlane(Origin=Point(0, 0, 0))
graft_2 = GraftTree(Tree=layer_2.Name, IncludeEmptyLists=True, IncludeNullItems=True)
crv_2 = Curve(object_2.Geometry)
svg_layout_2 = SVGLayout(Plane=xy_2, Dimensions="A4 (L)", Scale="1:50", Location=Toggle(True))  # -> L, R
json_2 = CreateJSON(Keys="layer", Values=graft_2)
topoly = CurveToPolyline(Curve=crv_2, ToleranceDistance="0.01", ToleranceAngle=0)  # -> Polyline, Segments
item_2 = ListItem(List=layer_2.Name, Index=0, Wrap=True)
unflatten = UnflattenTree(Tree=json_2, Guide=topoly.Polyline)
geo2arch_3 = Geo2Arch(Geometry=topoly.Polyline, Properties=unflatten)
rep = ReplaceText(Text="svgOutput\svgdemo_#.svg", Find="#", Replace=item_2, RecursiveReplace=False)
rel_path_3 = RelativePath(Path=Toggle(True), RelativePath=rep)  # -> FullPath, Directory, FileName
svg_3 = SVGGenerator(JO=geo2arch_3, LA=svg_layout_2.L, CSS=panel_5)
write_3 = WriteFile(Run=Toggle(True), Content=svg_3, FileDirectory=rel_path_3.Directory, FileName=rel_path_3.FileName)
panel_6 = Panel(write_3)
