# Grasshopper definition 10 Dome experiment.ghx (Grasshopper 1.0.8)
# plug-ins: Kangaroo2 Components

pt = Point(<point referenced from the Rhino model>)
number_slider = Slider(4216, range=3000..5000)
xy = XYPlane(Origin=pt)
Z = UnitZ(Factor="-1")
number_slider_2 = Slider(4000, range=500..5000)
number_slider_3 = Slider(1000, range=500..5000)
number_slider_4 = Slider(2500, range=500..5000)
number_slider_5 = Slider(1500, range=500..5000)
number_slider_6 = Slider(3000, range=500..5000)
move = Move(Geometry=xy, Motion=Z)  # -> Geometry, Transform
pt_2 = Point(<point referenced from the Rhino model>)
pt_3 = Point(<point referenced from the Rhino model>)
pt_4 = Point(<point referenced from the Rhino model>)
pt_5 = Point(<point referenced from the Rhino model>)
pt_6 = Point(<point referenced from the Rhino model>)
msphere = MeshSphere(Base=xy, Radius=number_slider, UCount=Slider(10, range=5..20), VCount=Slider(10, range=5..20))
xy_2 = XYPlane(Origin=pt_2)
msplit = MeshSplitPlane(Mesh=msphere, Plane=move.Geometry)  # -> Above, Below
xy_3 = XYPlane(Origin=pt_4)
xy_4 = XYPlane(Origin=pt_6)
xy_5 = XYPlane(Origin=pt_5)
xy_6 = XYPlane(Origin=pt_3)
number_slider_7 = Slider(50, range=50..100)
medges = MeshEdges(Mesh=msplit.Above)  # -> NakedEdges, InteriorEdges, NonManifoldEdges
sphere = Sphere(Base=xy_2, Radius=number_slider_2)
sphere_2 = Sphere(Base=xy_3, Radius=number_slider_5)
sphere_3 = Sphere(Base=xy_4, Radius=number_slider_3)
sphere_4 = Sphere(Base=xy_5, Radius=number_slider_4)
sphere_5 = Sphere(Base=xy_6, Radius=number_slider_6)
pipe = Pipe(Curve=medges.InteriorEdges, Radius=number_slider_7, Caps=0)
addition = Addition(A=number_slider, B=number_slider_7)
graft = GraftTree(Tree=[xy_2, xy_6, xy_5, xy_4, xy_3], IncludeEmptyLists=True, IncludeNullItems=True)
graft_2 = GraftTree(
    Tree=[number_slider_2, number_slider_6, number_slider_4, number_slider_3, number_slider_5],
    IncludeEmptyLists=True,
    IncludeNullItems=True)
panel = Panel("C:\Users\xlydi\OneDrive\Documents\GitHub\Archipunk-Lydia-and-Freya\10 art.png")
cir = Circle(Plane=graft, Radius=graft_2)
cir_2 = Circle(Plane=xy, Radius=addition)
sph = Sphere(Base=xy, Radius=addition)
solid_union = SolidUnion(Breps=[sphere, sphere_5, sphere_4, sphere_3, sphere_2])
runion = RegionUnion(Curves=flatten(cir))
srfsplit = SurfaceSplit(Surface=sph, Curves=cir_2)
split_brep = SplitBrep(Brep=solid_union, Cutter=runion)
crv = Curve(<curve referenced from the Rhino model>)
item = ListItem(List=srfsplit, Index="0", Wrap=True)
path = FilePath(panel)
img = ImportImage(File=path, Rectangle=crv)

# ---- group: gradually increase this until circles are packed
number_slider_8 = Slider(1.258, range=0..20)

# ----
list_item = ListItem(List=split_brep, Index="0", Wrap=True)
N = Count(1700)
mesh = Mesh(img)
qrsettings = QuadRemeshSettings(TargetCount=1000, AdaptiveSize=0, AdaptiveCount=False, HardEdges=False, SeamEdges=0, Symmetry=0, GuideCurves=0)
pop2d = Populate2D(Region=crv, Count=N, Seed=1)
multiplication = Multiplication(A=Slider(10.792, range=1..100), B=number_slider_8)
multiplication_2 = Multiplication(A=Slider(72.317, range=1..100), B=number_slider_8)
qrmesh = QuadRemesh(Mesh=list_item, Settings={aqc=True, as=50, dhe=True, gci=0, null=False, pme=0, sa=0, tqc=2000})
imgcircles = ImageCircles(Points=pop2d, Mesh=mesh, Min=multiplication, Max=multiplication_2, Curves=crv, Strength=1)
medges_2 = MeshEdges(Mesh=qrmesh)  # -> NakedEdges, InteriorEdges, NonManifoldEdges
face_boundaries = FaceBoundaries(Mesh=qrmesh)
mesh_2 = MeshBrep(
    Brep=item,
    Settings={GridMaxCount=0, GridMinCount=16, JaggedSeams=False, MaxEdgeLength=0, MinEdgeLength=0.0001, MinTolerance=0, Refine=True, RefineAngle=0, RelativeTolerance=0.65, SimplePlanes=True, Tolerance=0})
solver = Solver(GoalObjects=imgcircles, Reset=Button(), Threshold=1e-15, Tolerance=0.01, On=Toggle(True))  # -> I, V, O
number_slider_9 = Slider(50, range=10..100)
Z_2 = UnitZ(Factor=1)
cir_3 = Circle(Plane=solver.V, Radius=solver.O)
neg = Negative(Value=Z_2)
pipe_2 = Pipe(Curve=medges_2.InteriorEdges, Radius=number_slider_9, Caps=0)
area = Area(Geometry=cir_3)  # -> Area, Centroid
meshray = MeshRay(Mesh=mesh_2, Point=area.Centroid, Direction=neg)  # -> Point, Hit
srf_cp = SurfaceClosestPoint(Point=meshray.Point, Surface=item)  # -> Point, UVPoint, Distance
evalsrf = EvaluateSurface(Surface=item, Point=srf_cp.UVPoint)  # -> Point, Normal, UDirection, VDirection, Frame
xy_7 = XYPlane(Origin=Point(0, 0, 0))
addition_2 = Addition(A=number_slider_2, B=number_slider_9)
pl_origin = PlaneOrigin(Base=xy_7, Origin=area.Centroid)
panel_2 = Panel("C:\Users\xlydi\OneDrive\Documents\GitHub\Archipunk-Lydia-and-Freya\10 art.png")
orient = Orient(Geometry=cir_3, Source=pl_origin, Target=evalsrf.Frame)  # -> Geometry, Transform
cir_4 = Circle(Plane=xy_2, Radius=addition_2)
sph_2 = Sphere(Base=xy_2, Radius=addition_2)
pull = PullCurve(Curve=orient.Geometry, Surface=item)
srfsplit_2 = SurfaceSplit(Surface=sph_2, Curves=cir_4)
crv_2 = Curve(<curve referenced from the Rhino model>)
item_2 = ListItem(List=srfsplit_2, Index="0", Wrap=True)
path_2 = FilePath(panel_2)
genes = GenePool(Decimals=0, Maximum=5000, Minimum=0, Value=[5000, 4186, 1516, 3815, 2542])
img_2 = ImportImage(File=path_2, Rectangle=crv_2)

# ---- group: gradually increase this until circles are packed
number_slider_10 = Slider(1.305, range=0..20)

# ----
xy_8 = XYPlane(Origin=Point(0, 0, 0))
N_2 = Count(1700)
mesh_3 = Mesh(img_2)
sphere_6 = Sphere(Base=xy_8, Radius=1)
pop2d_2 = Populate2D(Region=crv_2, Count=N_2, Seed=1)
multiplication_3 = Multiplication(A=Slider(15.185, range=1..100), B=number_slider_10)
multiplication_4 = Multiplication(A=Slider(72.317, range=1..100), B=number_slider_10)
construct_point = ConstructPoint(XCoordinate=0, YCoordinate=0, ZCoordinate=Slider(-1200, range=-1200..2000))
imgcircles_2 = ImageCircles(Points=pop2d_2, Mesh=mesh_3, Min=multiplication_3, Max=multiplication_4, Curves=crv_2, Strength=1)
xy_plane = XYPlane(Origin=construct_point)
mesh_4 = MeshBrep(
    Brep=item_2,
    Settings={GridMaxCount=0, GridMinCount=16, JaggedSeams=False, MaxEdgeLength=0, MinEdgeLength=0.0001, MinTolerance=0, Refine=True, RefineAngle=0, RelativeTolerance=0.65, SimplePlanes=True, Tolerance=0})
solver_2 = Solver(GoalObjects=imgcircles_2, Reset=Button(), Threshold=1e-15, Tolerance=0.01, On=Toggle(True))  # -> I, V, O
brep_plane = BrepPlane(Plane=xy_plane)  # -> Curves, Points
Z_3 = UnitZ(Factor=1)
cir_5 = Circle(Plane=solver_2.V, Radius=solver_2.O)
neg_2 = Negative(Value=Z_3)
area_2 = Area(Geometry=cir_5)  # -> Area, Centroid
meshray_2 = MeshRay(Mesh=mesh_4, Point=area_2.Centroid, Direction=neg_2)  # -> Point, Hit
srf_cp_2 = SurfaceClosestPoint(Point=meshray_2.Point, Surface=item_2)  # -> Point, UVPoint, Distance
evalsrf_2 = EvaluateSurface(Surface=item_2, Point=srf_cp_2.UVPoint)  # -> Point, Normal, UDirection, VDirection, Frame
xy_9 = XYPlane(Origin=Point(0, 0, 0))
triremesh = TriRemesh(Length=Slider(29, range=0..500), Iterations=25)  # -> Triangulation, Dual, Creases
pl_origin_2 = PlaneOrigin(Base=xy_9, Origin=area_2.Centroid)
orient_2 = Orient(Geometry=cir_5, Source=pl_origin_2, Target=evalsrf_2.Frame)  # -> Geometry, Transform
pull_2 = PullCurve(Curve=orient_2.Geometry, Surface=item_2)
list_item_2 = ListItem(Index=Slider(5, range=0..10), Wrap=True)
volume = Volume(Geometry=list_item_2)  # -> Volume, Centroid
number_slider_11 = Slider(0.92, range=0..1)
number_slider_12 = Slider(0.58, range=0..1)
polygon_center = PolygonCenter()  # -> CenterV, CenterE, CenterA
distance = Distance(PointA=polygon_center.CenterV, PointB=volume.Centroid)
construct_domain = ConstructDomain(DomainStart=number_slider_11, DomainEnd=number_slider_12)
bounds = Bounds(Numbers=distance)
remap_numbers = RemapNumbers(Value=distance, Source=bounds, Target=construct_domain)  # -> Mapped, Clipped
scale = Scale(Center=polygon_center.CenterV, Factor=remap_numbers.Mapped)  # -> Geometry, Transform
gradient = Gradient(
    LowerLimit=number_slider_11,
    UpperLimit=number_slider_12,
    Parameter=remap_numbers.Mapped,
    stops=[0.15: RGB(255, 130, 160), 0.85: RGB(220, 0, 40)])
ruled_surface = RuledSurface(CurveB=scale.Geometry)
custom_preview = CustomPreview(Geometry=ruled_surface, Material=gradient)
