# Grasshopper definition 11 Contour meshing.gh (Grasshopper 1.0.8)
# plug-ins: Kangaroo2 Components

crv = Curve(graft([<curve referenced from the Rhino model> x75]))
divlength = DivideLength(Curve=crv, Length=Slider(12000, range=1000..15000))  # -> Points, Tangents, Parameters
pline = PolyLine(Vertices=divlength.Points, Closed=False)
crv_2 = Curve([<curve referenced from the Rhino model> x10])
triremesh = TriRemesh(Iterations=25)  # -> Triangulation, Dual, Creases
