# Grasshopper definition 11 Structure.ghx (Grasshopper 1.0.8)
# plug-ins: Pufferfish, Kangaroo2 Components

number_slider = Slider(3000, range=1000..10000)
number_slider_2 = Slider(6000, range=1000..10000)
number_slider_3 = Slider(10000, range=1000..10000)
number_slider_4 = Slider(7000, range=1000..10000)
number_slider_5 = Slider(3000, range=1000..10000)
number_slider_6 = Slider(6000, range=1000..10000)
number_slider_7 = Slider(7000, range=1000..10000)
number_slider_8 = Slider(4800, range=1000..10000)
pt = Point(<point referenced from the Rhino model>)
pt_2 = Point(<point referenced from the Rhino model>)
pt_3 = Point(<point referenced from the Rhino model>)
pt_4 = Point(<point referenced from the Rhino model>)
pt_5 = Point(<point referenced from the Rhino model>)
pt_6 = Point(<point referenced from the Rhino model>)
pt_7 = Point(<point referenced from the Rhino model>)
pt_8 = Point(<point referenced from the Rhino model>)
xy = XYPlane(Origin=pt)
xy_2 = XYPlane(Origin=pt_3)
xy_3 = XYPlane(Origin=pt_5)
xy_4 = XYPlane(Origin=pt_4)
xy_5 = XYPlane(Origin=pt_2)
xy_6 = XYPlane(Origin=pt_8)
xy_7 = XYPlane(Origin=pt_7)
xy_8 = XYPlane(Origin=pt_6)
sphere = Sphere(Base=xy, Radius=number_slider_3)
sphere_2 = Sphere(Base=xy_6, Radius=number_slider)
sphere_3 = Sphere(Base=xy_7, Radius=number_slider_2)
sphere_4 = Sphere(Base=xy_2, Radius=number_slider_8)
sphere_5 = Sphere(Base=xy_8, Radius=number_slider_4)
sphere_6 = Sphere(Base=xy_3, Radius=number_slider_5)
sphere_7 = Sphere(Base=xy_4, Radius=number_slider_6)
sphere_8 = Sphere(Base=xy_5, Radius=number_slider_7)
msphere = MeshSphere(Base=xy, Radius=number_slider_3, UCount=10, VCount=20)
msphere_2 = MeshSphere(Base=xy_5, Radius=number_slider_7, UCount=10, VCount=20)
msphere_3 = MeshSphere(Base=xy_4, Radius=number_slider_6, UCount=10, VCount=20)
msphere_4 = MeshSphere(Base=xy_2, Radius=number_slider_8, UCount=10, VCount=20)
msphere_5 = MeshSphere(Base=xy_3, Radius=number_slider_5, UCount=10, VCount=20)
msphere_6 = MeshSphere(Base=xy_8, Radius=number_slider_4, UCount=10, VCount=20)
msphere_7 = MeshSphere(Base=xy_7, Radius=number_slider_2, UCount=10, VCount=20)
msphere_8 = MeshSphere(Base=xy_6, Radius=number_slider, UCount=10, VCount=20)
graft = GraftTree(Tree=[pt, pt_2, pt_4, pt_5, pt_3], IncludeEmptyLists=True, IncludeNullItems=True)
graft_2 = GraftTree(Tree=[xy_8, xy_7, xy_6], IncludeEmptyLists=True, IncludeNullItems=True)
graft_3 = GraftTree(Tree=[number_slider_4, number_slider_2, number_slider], IncludeEmptyLists=True, IncludeNullItems=True)
graft_4 = GraftTree(Tree=[xy, xy_5, xy_4, xy_3, xy_2], IncludeEmptyLists=True, IncludeNullItems=True)
graft_5 = GraftTree(
    Tree=[number_slider_3, number_slider_7, number_slider_6, number_slider_5, number_slider_8],
    IncludeEmptyLists=True,
    IncludeNullItems=True)
munion = MeshUnion(Meshes=[msphere, msphere_2, msphere_4])
munion_2 = MeshUnion(Meshes=[msphere_3, msphere_5])
munion_3 = MeshUnion(Meshes=[msphere_6, msphere_7, msphere_8])
cir = Circle(Plane=graft_2, Radius=graft_3)
cir_2 = Circle(Plane=graft_4, Radius=graft_5)
solid_union = SolidUnion(Breps=[sphere_5, sphere_3, sphere_2])
Y = UnitY(Factor=1)
solid_union_2 = SolidUnion(Breps=[sphere, sphere_8, sphere_7, sphere_6, sphere_4])
runion = RegionUnion(Curves=flatten(cir))
msplit = MeshSplit(Mesh=munion, Splitters=munion_2)
msplit_2 = MeshSplit(Mesh=munion_2, Splitters=munion)
rot3d = Rotate3D(Geometry=cir_2, Angle=degrees("90"), Center=graft, Axis=Y)  # -> Geometry, Transform
munion_4 = MeshUnion(Meshes=[msphere, msphere_2, msphere_4, msphere_3, msphere_5])
runion_2 = RegionUnion(Curves=flatten(cir_2))
sdiff = SolidDifference(BrepsA=solid_union_2, BrepsB=solid_union)
list_item = ListItem(List=msplit, Index="0", Wrap=True)
list_item_2 = ListItem(List=msplit_2, Index="0", Wrap=True)
split_brep = SplitBrep(Brep=solid_union_2, Cutter=runion_2)
panel = Panel("""0
1
2
3
4""")
debrep = DeconstructBrep(Brep=sdiff)  # -> Faces, Edges, Vertices
msplit_3 = MeshSplit(Mesh=munion_4, Splitters=munion_3)
msplit_4 = MeshSplit(Mesh=[list_item, list_item_2], Splitters=munion_3)
list_item_3 = ListItem(List=split_brep, Index="0", Wrap=True)
list_item_4 = ListItem(List=debrep.Faces, Index=panel, Wrap=True)
list_item_5 = ListItem(List=msplit_3, Index="0", Wrap=True)
list_item_6 = ListItem(List=msplit_4, Index="0", Wrap=True)
join = BrepJoin(Breps=list_item_4)  # -> Breps, Closed
msplit_5 = MeshSplitPlane(Mesh=list_item_6, Plane=xy)  # -> Above, Below
msplit_6 = MeshSplitPlane(Mesh=list_item_5, Plane=xy)  # -> Above, Below
rdiff = RegionDifference(CurvesA=runion_2, CurvesB=runion)
list_item_7 = ListItem(List=msplit_5.Above, Index="0", Wrap=True)
list_item_8 = ListItem(List=msplit_6.Above, Index="0", Wrap=True)
split_brep_2 = SplitBrep(Brep=join.Breps, Cutter=rdiff)
list_item_9 = ListItem(List=flatten(list_item_7), Index="0", Wrap=True)
list_item_10 = ListItem(List=flatten(list_item_7), Index="1", Wrap=True)
list_item_11 = ListItem(List=split_brep_2, Index="0", Wrap=True)
medges = MeshEdges(Mesh=list_item_9)  # -> NakedEdges, InteriorEdges, NonManifoldEdges
medges_2 = MeshEdges(Mesh=list_item_10)  # -> NakedEdges, InteriorEdges, NonManifoldEdges
number_slider_9 = Slider(50, range=0..100)
crv = Curve([medges_2.NakedEdges, medges_2.InteriorEdges])
crv_2 = Curve([medges.NakedEdges, medges.InteriorEdges])
qrsettings = QuadRemeshSettings(TargetCount=1000, AdaptiveSize=0, AdaptiveCount=False, HardEdges=False, SeamEdges=0, Symmetry=0, GuideCurves=0)
qrmesh = QuadRemesh(Mesh=list_item_11, Settings=qrsettings)
polygon = Polygon(Plane=PlaneXY(0, 0, 0), Radius=number_slider_9, Segments=Slider(4, range=3..8), FilletRadius=0)  # -> Polygon, Length
polygon_2 = Polygon(Plane=PlaneXY(0, 0, 0), Radius=Slider(50, range=0..100), Segments=Slider(4, range=3..8), FilletRadius=0)  # -> Polygon, Length
pipe = Pipe(Radius=1, Caps=0)
pframes = PerpFrames(Curve=crv, Count="1", Align=True)  # -> Frames, Parameters
pframes_2 = PerpFrames(Curve=crv_2, Count="1", Align=True)  # -> Frames, Parameters
rotate = Rotate(Geometry=polygon.Polygon, Angle=degrees(Slider(45, range=0..360)), Plane=PlaneXY(0, 0, 0))  # -> Geometry, Transform
rotate_2 = Rotate(Geometry=polygon_2.Polygon, Angle=degrees(Slider(45, range=0..360)), Plane=PlaneXY(0, 0, 0))  # -> Geometry, Transform
medges_3 = MeshEdges(Mesh=qrmesh)  # -> NakedEdges, InteriorEdges, NonManifoldEdges
graft_6 = GraftTree(Tree=crv, IncludeEmptyLists=True, IncludeNullItems=True)
graft_7 = GraftTree(Tree=crv_2, IncludeEmptyLists=True, IncludeNullItems=True)
area = Area(Geometry=rotate.Geometry)  # -> Area, Centroid
area_2 = Area(Geometry=rotate_2.Geometry)  # -> Area, Centroid
orient = Orient(Geometry=rotate.Geometry, Source=area.Centroid, Target=pframes.Frames)  # -> Geometry, Transform
orient_2 = Orient(Geometry=rotate_2.Geometry, Source=area_2.Centroid, Target=pframes_2.Frames)  # -> Geometry, Transform
swp1 = Sweep1(Rail=graft_6, Sections=orient.Geometry, Miter=1)
swp1_2 = Sweep1(Rail=graft_7, Sections=orient_2.Geometry, Miter=1)
pipe_2 = Pipe(Curve=[medges_3.NakedEdges, medges_3.InteriorEdges], Radius=Slider(20, range=10..100), Caps=0)
panel_2 = Panel("C:\Users\xlydi\OneDrive\Documents\GitHub\Archipunk-Lydia-and-Freya\10 art.png")
addition = Addition(A=number_slider_3, B=number_slider_9)
neg = Negative(Value=number_slider_9)
cir_3 = Circle(Plane=xy, Radius=addition)
sph = Sphere(Base=xy, Radius=addition)
offmsh = OffsetMesh(Mesh=list_item_8, Distance=neg, BothSides=0, CreateSolid=invert(True))
offmsh_2 = OffsetMesh(Mesh=list_item_8, Distance=number_slider_9, BothSides=0, CreateSolid=invert(True))
crv_3 = Curve(<curve referenced from the Rhino model>)
path = FilePath(panel_2)
srfsplit = SurfaceSplit(Surface=sph, Curves=cir_3)
img = ImportImage(File=path, Rectangle=crv_3)

# ---- group: gradually increase this until circles are packed
number_slider_10 = Slider(2.464, range=0..20)

# ----
item = ListItem(List=srfsplit, Index="0", Wrap=True)
N = Count(1700)
mesh = Mesh(img)
pop2d = Populate2D(Region=crv_3, Count=N, Seed=1)
multiplication = Multiplication(A=Slider(23.458, range=1..100), B=number_slider_10)
multiplication_2 = Multiplication(A=Slider(100, range=1..100), B=number_slider_10)
msh2psrf = MeshToPolysurface(Mesh=offmsh, Triangles=False, FaceMerge=False)
msh2psrf_2 = MeshToPolysurface(Mesh=offmsh_2, Triangles=False, FaceMerge=False)
explode = ExplodeObject(Object=msh2psrf, Recursive=False)  # -> graft(Objects)
explode_2 = ExplodeObject(Object=msh2psrf_2, Recursive=False)  # -> graft(Objects)
imgcircles = ImageCircles(Points=pop2d, Mesh=mesh, Min=multiplication, Max=multiplication_2, Curves=crv_3, Strength=1)
Z = UnitZ(Factor=1)
neg_2 = Negative(Value=Z)
area_3 = Area(Geometry=explode)  # -> Area, Centroid
rebsrf = RebuildSurface(Surface=explode_2, DegreeU="2", DegreeV="2")
solver = Solver(GoalObjects=imgcircles, Reset=Button(), Threshold=1e-15, Tolerance=0.01, On=Toggle(True))  # -> I, V, O
scale = Scale(Geometry=explode, Center=area_3.Centroid, Factor=Slider(0.967, range=0..1))  # -> Geometry, Transform
srfpt = SurfacePoints(Surface=rebsrf)  # -> Points, Weights, Greville, UCount, VCount
cir_4 = Circle(Plane=solver.V, Radius=solver.O)
number_slider_11 = Slider(1000, range=0..1500)
area_4 = Area(Geometry=explode_2)  # -> Area, Centroid
item_2 = ListItem(List=srfpt.Points, Index="4", Wrap=True)
xy_9 = XYPlane(Origin=Point(0, 0, 0))
multiplication_3 = Multiplication(A=area_4.Area, B=Slider(0.00024, range=0..0.001))
area_5 = Area(Geometry=cir_4)  # -> Area, Centroid
meshray = MeshRay(Mesh=item, Point=area_5.Centroid, Direction=neg_2)  # -> Point, Hit
srf_cp = SurfaceClosestPoint(Point=meshray.Point, Surface=item)  # -> Point, UVPoint, Distance
evalsrf = EvaluateSurface(Surface=item, Point=srf_cp.UVPoint)  # -> Point, Normal, UDirection, VDirection, Frame
pl_origin = PlaneOrigin(Base=xy_9, Origin=area_5.Centroid)
moveaway = MoveAwayFrom(Geometry=item_2, Emitter=rebsrf, Distance=multiplication_3)  # -> Geometry, Transform
orient_3 = Orient(Geometry=cir_4, Source=pl_origin, Target=evalsrf.Frame)  # -> Geometry, Transform
vec2pt = Vector2Pt(PointA=item_2, PointB=moveaway.Geometry, Unitize=False)  # -> Vector, Length
pull = PullCurve(Curve=orient_3.Geometry, Surface=msh2psrf)
pdeform = PointDeform(Geometry=rebsrf, Points=item_2, Motion=vec2pt.Vector)
amp = Amplitude(Vector=evalsrf.Normal, Amplitude=Slider(100, range=0..100))
neg_3 = Negative(Value=amp)
merge = Merge(Data1=graft(amp), Data2=graft(neg_3))
extr = Extrude(Base=graft(orient_3.Geometry), Direction=merge)
join_2 = BrepJoin(Breps=extr)  # -> flatten(Breps), Closed
split = SplitList(List=flatten(join_2.Breps), Index=Slider(180, range=0..1000))  # -> ListA, ListB
geo = Geometry(split.ListA)
splitmul = SplitBrepMultiple(Brep=msh2psrf)
item_3 = ListItem(List=splitmul, Index="2", Wrap=True)
panel_3 = Panel(splitmul)

# ---- group: 3d printing
msplit_7 = MeshSplitPlane(Mesh=list_item_2, Plane=xy)  # -> Above, Below
number_slider_12 = Slider(300, range=0..1000)
list_item_12 = ListItem(List=msplit_7.Above, Index="0", Wrap=True)
list_item_13 = ListItem(List=flatten(msplit_4), Index="1", Wrap=True)
msh2psrf_3 = MeshToPolysurface(Mesh=list_item_9, Triangles=False, FaceMerge=False)
msh2psrf_4 = MeshToPolysurface(Mesh=list_item_10, Triangles=False, FaceMerge=False)
boundary = BoundarySurfaces(Edges=runion_2)
msh2psrf_5 = MeshToPolysurface(Mesh=list_item_12, Triangles=False, FaceMerge=False)
msplit_8 = MeshSplitPlane(Mesh=list_item_13, Plane=xy)  # -> Above, Below
neg_4 = Negative(Value=Slider(300, range=0..300))
neg_5 = Negative(Value=Slider(300, range=0..300))
neg_6 = Negative(Value=Slider(200, range=0..300))
list_item_14 = ListItem(List=msplit_8.Above, Index="0", Wrap=True)
offsrf = OffsetSurface(Surface=msh2psrf_4, Distance=neg_5, BothSides=0, CreateSolid=True)
offsrf_2 = OffsetSurface(Surface=msh2psrf_3, Distance=neg_4, BothSides=0, CreateSolid=True)
offsrf_3 = OffsetSurface(Surface=msh2psrf_5, Distance=neg_6, BothSides=0, CreateSolid=True)
msh2psrf_6 = MeshToPolysurface(Mesh=list_item_14, Triangles=False, FaceMerge=False)
neg_7 = Negative(Value=Slider(300, range=0..300))
offsrf_4 = OffsetSurface(Surface=msh2psrf_6, Distance=neg_7, BothSides=0, CreateSolid=True)

# ----
neg_8 = Negative(Value=number_slider_12)

# ---- group: 3d printing (continued)
Z_2 = UnitZ(Factor=neg_8)
extr_2 = Extrude(Base=boundary, Direction=Z_2)
