# Grasshopper definition Gear Trial 1.ghx (Grasshopper 1.0.8)

number_slider = Slider(6, range=0..100)
radius = Slider(10, range=0..10)
number_slider_2 = Slider(10, range=0..100)
radius_2 = Slider(2, range=0..10)
number_slider_3 = Slider(53, range=0..100)
radius_3 = Slider(10, range=0..10)
division = Division(A=radius, B=Slider(1.053, range=0..10))
pi = Pi(Factor="2")
modulus = Modulus(A=number_slider, B=Slider(9, range=0..100))
circle = Circle(Plane=PlaneXY(0, 0, 0), Radius=radius)
division_2 = Division(A=radius_3, B=Slider(1.093, range=0..10))
modulus_2 = Modulus(A=number_slider_2, B=Slider(2, range=0..100))
construct_point = ConstructPoint(XCoordinate="0", YCoordinate="0", ZCoordinate="0")
circle_2 = Circle(Plane=PlaneXY(0, 0, 0), Radius=radius_2)
circle_3 = Circle(Plane=PlaneXY(0, 0, 0), Radius=division)
modulus_3 = Modulus(A=number_slider_3, B=Slider(13, range=0..100))
circle_4 = Circle(Plane=PlaneXY(0, 0, 0), Radius=radius_3)
circle_5 = Circle(Plane=PlaneXY(0, 0, 0), Radius=Slider(0.881, range=0..10))
addition = Addition(A=number_slider, B=modulus)
integer = Integer(addition)
circle_6 = Circle(Plane=PlaneXY(0, 0, 0), Radius=division_2)
division_3 = Division(A=pi, B="60")
addition_2 = Addition(A=number_slider_2, B=modulus_2)
integer_2 = Integer(addition_2)
addition_3 = Addition(A=number_slider_3, B=modulus_3)
integer_3 = Integer(addition_3)
divide_curve = DivideCurve(Curve=circle, Count=addition, Kinks=False)  # -> Points, Tangents, Parameters
trigger = Trigger(Interval=1000, TimerInterval=1000, Target=data_recorder)
degrees = Degrees(Radians=division_3)
divide_curve_2 = DivideCurve(Curve=circle_2, Count=addition_2, Kinks=False)  # -> Points, Tangents, Parameters
pi_2 = Pi(Factor=2)
division_4 = Division(A=pi_2, B=addition)
divide_curve_3 = DivideCurve(Curve=circle_4, Count=addition_3, Kinks=False)  # -> Points, Tangents, Parameters
pi_3 = Pi(Factor=2)
pi_4 = Pi(Factor=2)
division_5 = Division(A=pi_4, B=addition_3)
concatenate = Concatenate(FragmentA=degrees, FragmentB="deg.")
dispatch = Dispatch(List=divide_curve.Points, DispatchPattern=[True, False])  # -> ListA, ListB
data_recorder = DataRecorder(degrees, DataLimit=-10, RecordData=False)  # disabled
division_6 = Division(A=pi_3, B=addition_2)
dispatch_2 = Dispatch(List=divide_curve_2.Points, DispatchPattern=[True, False])  # -> ListA, ListB
dispatch_3 = Dispatch(List=divide_curve_3.Points, DispatchPattern=[True, False])  # -> ListA, ListB
panel = Panel(concatenate)
mass_addition = MassAddition(Input=degrees)  # -> Result, PartialResults
line = Line(StartPoint=dispatch.ListA, EndPoint=dispatch.ListB)
line_2 = Line(StartPoint=dispatch_2.ListA, EndPoint=dispatch_2.ListB)
line_3 = Line(StartPoint=dispatch_3.ListA, EndPoint=dispatch_3.ListB)
unit_z = UnitZ(Factor=1)
pi_5 = Pi(Factor=-0.5)
number_slider_4 = Slider(12, range=0..100)
unit_z_2 = UnitZ(Factor=1)
multiplication = Multiplication(A=mass_addition.Result, B=Slider(73, range=0..100))
vector = Vector(line)
pi_6 = Pi(Factor=-0.5)
unit_z_3 = UnitZ(Factor=1)
pi_7 = Pi(Factor=-0.5)
vector_2 = Vector(line_2)
vector_3 = Vector(line_3)
rotate = Rotate(Vector=vector, Axis=unit_z, Angle=pi_5)
data_recorder_2 = DataRecorder(multiplication, DataLimit=-10, RecordData=True)  # disabled
rotate_2 = Rotate(Vector=vector_2, Axis=unit_z_2, Angle=pi_6)
rotate_3 = Rotate(Vector=vector_3, Axis=unit_z_3, Angle=pi_7)
amplitude = Amplitude(Vector=rotate, Amplitude=Slider(3, range=0..10))
amplitude_2 = Amplitude(Vector=rotate_2, Amplitude=Slider(8, range=0..10))
point_polar = PointPolar(BasePlane=construct_point, XYAngle=data_recorder_2, ZAngle=0, Offset=Slider(12, range=0..100))
amplitude_3 = Amplitude(Vector=rotate_3, Amplitude=Slider(1, range=0..10))
move = Move(Geometry=line, Motion=amplitude)  # -> Geometry, Transform
move_2 = Move(Geometry=line_2, Motion=amplitude_2)  # -> Geometry, Transform
move_3 = Move(Geometry=line_3, Motion=amplitude_3)  # -> Geometry, Transform
curve = Curve(line)
curve_2 = Curve(line_2)
evaluate_length = EvaluateLength(Curve=move.Geometry, Length=0.5, Normalized=True)  # -> Point, Tangent, Parameter
number_slider_5 = Slider(0.45, range=0..1)
number_slider_6 = Slider(1, range=0..1)
curve_3 = Curve(line_3)
evaluate_length_2 = EvaluateLength(Curve=move_2.Geometry, Length=0.5, Normalized=True)  # -> Point, Tangent, Parameter
evaluate_length_3 = EvaluateLength(Curve=move_3.Geometry, Length=0.5, Normalized=True)  # -> Point, Tangent, Parameter
evaluate_length_4 = EvaluateLength(Curve=curve, Length=0.5, Normalized=True)  # -> Point, Tangent, Parameter
number_slider_7 = Slider(0.74, range=0..1)
evaluate_length_5 = EvaluateLength(Curve=curve_2, Length=0.5, Normalized=True)  # -> Point, Tangent, Parameter
evaluate_length_6 = EvaluateLength(Curve=curve_3, Length=0.5, Normalized=True)  # -> Point, Tangent, Parameter
division_7 = Division(A="1", B=number_slider_5)
division_8 = Division(A="1", B=number_slider_6)
division_9 = Division(A="1", B=number_slider_7)
scale = Scale(Geometry=move.Geometry, Center=evaluate_length.Point, Factor=number_slider_5)  # -> Geometry, Transform
scale_2 = Scale(Geometry=curve, Center=evaluate_length_4.Point, Factor=division_7)  # -> Geometry, Transform
scale_3 = Scale(Geometry=move_2.Geometry, Center=evaluate_length_2.Point, Factor=number_slider_6)  # -> Geometry, Transform
scale_4 = Scale(Geometry=curve_2, Center=evaluate_length_5.Point, Factor=division_8)  # -> Geometry, Transform
scale_5 = Scale(Geometry=move_3.Geometry, Center=evaluate_length_3.Point, Factor=number_slider_7)  # -> Geometry, Transform
scale_6 = Scale(Geometry=curve_3, Center=evaluate_length_6.Point, Factor=division_9)  # -> Geometry, Transform
shift_list = ShiftList(List=scale_2.Geometry, Shift=1, Wrap=True)
end_points = EndPoints(Curve=scale_2.Geometry)  # -> Start, End
end_points_2 = EndPoints(Curve=scale.Geometry)  # -> Start, End
shift_list_2 = ShiftList(List=scale_4.Geometry, Shift=1, Wrap=True)
end_points_3 = EndPoints(Curve=scale_4.Geometry)  # -> Start, End
end_points_4 = EndPoints(Curve=scale_3.Geometry)  # -> Start, End
shift_list_3 = ShiftList(List=scale_6.Geometry, Shift=1, Wrap=True)
end_points_5 = EndPoints(Curve=scale_6.Geometry)  # -> Start, End
end_points_6 = EndPoints(Curve=scale_5.Geometry)  # -> Start, End
end_points_7 = EndPoints(Curve=shift_list)  # -> Start, End
end_points_8 = EndPoints(Curve=shift_list_2)  # -> Start, End
end_points_9 = EndPoints(Curve=shift_list_3)  # -> Start, End
line_4 = Line(StartPoint=end_points_2.Start, EndPoint=end_points.Start)
line_5 = Line(StartPoint=end_points_2.End, EndPoint=end_points.End)
line_6 = Line(StartPoint=end_points_4.Start, EndPoint=end_points_3.Start)
line_7 = Line(StartPoint=end_points_4.End, EndPoint=end_points_3.End)
line_8 = Line(StartPoint=end_points_6.Start, EndPoint=end_points_5.Start)
line_9 = Line(StartPoint=end_points.End, EndPoint=end_points_7.Start)
line_10 = Line(StartPoint=end_points_6.End, EndPoint=end_points_5.End)
line_11 = Line(StartPoint=end_points_3.End, EndPoint=end_points_8.Start)
line_12 = Line(StartPoint=end_points_5.End, EndPoint=end_points_9.Start)
merge = Merge(Data1=scale.Geometry, Data2=line_4, Data3=line_5, Data4=line_9)  # -> flatten(Result)
merge_2 = Merge(Data1=scale_3.Geometry, Data2=line_6, Data3=line_7, Data4=line_11)  # -> flatten(Result)
merge_3 = Merge(Data1=scale_5.Geometry, Data2=line_8, Data3=line_10, Data4=line_12)  # -> flatten(Result)
number = Number(division_4)
number_2 = Number(division_6)
join_curves = JoinCurves(Curves=merge, Preserve=False)
number_3 = Number(division_5)
join_curves_2 = JoinCurves(Curves=merge_2, Preserve=False)
join_curves_3 = JoinCurves(Curves=merge_3, Preserve=False)
division_10 = Division(A=number, B=2)
division_11 = Division(A=number_2, B=2)
division_12 = Division(A=number_3, B=2)
curve_4 = Curve(circle_3)
curve_5 = Curve(circle_5)
curve_6 = Curve(circle_6)
move_4 = Move(Geometry=curve_4, Motion=Vector(0, 0, 10))  # -> Geometry, Transform
move_5 = Move(Geometry=curve_5, Motion=Vector(0, 0, 10))  # -> Geometry, Transform
move_6 = Move(Geometry=curve_6, Motion=Vector(0, 0, 10))  # -> Geometry, Transform
rotate_4 = Rotate(Geometry=join_curves, Angle=division_10, Plane=PlaneXY(0, 0, 0))  # -> Geometry, Transform
rotate_5 = Rotate(Geometry=join_curves_2, Angle=division_11, Plane=PlaneXY(0, 0, 0))  # -> Geometry, Transform
rotate_6 = Rotate(Geometry=join_curves_3, Angle=division_12, Plane=PlaneXY(0, 0, 0))  # -> Geometry, Transform
number_4 = Number(Slider(60, range=0..100))
number_5 = Number(Slider(9, range=0..100))
unit_x = UnitX(Factor=Slider(39, range=0..100))
number_6 = Number(Slider(83, range=0..100))
radians = Radians(Degrees=number_4)
rotate_7 = Rotate(Geometry=rotate_4.Geometry, Angle=radians, Plane=PlaneXY(0, 0, 0))  # -> Geometry, Transform
radians_2 = Radians(Degrees=number_5)
rotate_8 = Rotate(Geometry=rotate_5.Geometry, Angle=radians_2, Plane=PlaneXY(0, 0, 0))  # -> Geometry, Transform
radians_3 = Radians(Degrees=number_6)
rotate_9 = Rotate(Geometry=rotate_6.Geometry, Angle=radians_3, Plane=PlaneXY(0, 0, 0))  # -> Geometry, Transform
move_7 = Move(Geometry=[circle_3, rotate_7.Geometry], Motion=unit_x)  # -> Geometry, Transform
curve_7 = Curve(rotate_7.Geometry)
area = Area(Geometry=curve_7)  # -> Area, Centroid
curve_8 = Curve(rotate_8.Geometry)
area_2 = Area(Geometry=curve_8)  # -> Area, Centroid
curve_9 = Curve(rotate_9.Geometry)
area_3 = Area(Geometry=curve_9)  # -> Area, Centroid
rotate_10 = Rotate(Geometry=curve_7, Angle=degrees(1.570796327), Plane=area.Centroid)  # -> Geometry, Transform
rotate_11 = Rotate(Geometry=curve_8, Angle=degrees(1.570796327), Plane=area_2.Centroid)  # -> Geometry, Transform
rotate_12 = Rotate(Geometry=curve_9, Angle=degrees(1.570796327), Plane=area_3.Centroid)  # -> Geometry, Transform
