# Grasshopper definition Gear Trial 2.ghx (Grasshopper 1.0.8)

series = Series(Start=Slider(10, range=0..10), Step=1, Count=Slider(10, range=0..10))
number_slider = Slider(5, range=0..100)
circle = Circle(Plane=PlaneXY(0, 0, 0), Radius=Slider(6, range=0..50))
circle_2 = Circle(Plane=PlaneXY(0, 0, 0), Radius=Slider(19, range=0..50))
cull_index = CullIndex(List=circle_2, Indices=series, Wrap=True)
divide_curve = DivideCurve(Curve=circle, Count=number_slider, Kinks=False)  # -> Points, Tangents, Parameters
divide_curve_2 = DivideCurve(Curve=circle_2, Count=number_slider, Kinks=False)  # -> Points, Tangents, Parameters
series_2 = Series(Start=0, Step=1, Count=10)
shift_list = ShiftList(List=divide_curve.Points, Shift=Slider(0, range=0..10), Wrap=True)
line = Line(StartPoint=shift_list, EndPoint=divide_curve_2.Points)
curve_middle = CurveMiddle(Curve=line)
cull_index_2 = CullIndex(Wrap=True)
rotate = Rotate(Geometry=line, Angle=1.570796327, Plane=curve_middle)  # -> Geometry, Transform
divide_curve_3 = DivideCurve(Curve=line, Count=Slider(0, range=0..10), Kinks=False)  # -> Points, Tangents, Parameters
list_item = ListItem(List=divide_curve_3.Points, Index=0, Wrap=True)  # -> Item, flatten(Item1), flatten(Item2)
unit_vector = UnitVector(Vector=rotate.Geometry)
multiplication = Multiplication(A=unit_vector, B=Slider(0, range=0..10))
multiplication_2 = Multiplication(A=unit_vector, B=Slider(0, range=0..10))
move = Move(Geometry=list_item.Item1, Motion=multiplication)  # -> Geometry, Transform
move_2 = Move(Geometry=list_item.Item2, Motion=multiplication_2)  # -> Geometry, Transform
merge = Merge(
    Data1=simplify(graft(shift_list)),
    Data2=simplify(graft(move.Geometry)),
    Data3=simplify(graft(move_2.Geometry)),
    Data4=simplify(graft(divide_curve_2.Points)))
number_slider_2 = Slider(0.6, range=0..1)
interpolate = Interpolate(Vertices=merge, Degree=3, Periodic=False, KnotStyle=1)  # -> Curve, Length, Domain
negative = Negative(Value=Slider(2.61, range=0..10))
negative_2 = Negative(Value=Slider(3.75, range=0..10))
pipe = Pipe(Curve=interpolate.Curve, Radius=Slider(0.6, range=0..1), Caps=0)
pipe_2 = Pipe(Curve=circle_2, Radius=number_slider_2, Caps=0)
pipe_3 = Pipe(Curve=circle, Radius=number_slider_2, Caps=0)
offset_curve = OffsetCurve(Curve=circle_2, Distance=negative, Corners=1)
offset_curve_2 = OffsetCurve(Curve=circle, Distance=negative_2, Corners=1)
negative_3 = Negative(Value=Slider(0.82, range=0..10))
custom_preview = CustomPreview(Geometry=pipe_3, Material=ColourSwatch(SwatchColor=RGB(255, 254, 255)))
custom_preview_2 = CustomPreview(Geometry=pipe, Material=ColourSwatch(SwatchColor=RGB(255, 254, 255)))
custom_preview_3 = CustomPreview(Geometry=pipe_2, Material=ColourSwatch(SwatchColor=RGB(255, 254, 255)))
merge_2 = Merge(Data1=flatten(offset_curve), Data2=flatten(circle_2))
merge_3 = Merge(Data1=flatten(offset_curve_2), Data2=flatten(circle))
offset_curve_3 = OffsetCurve(Curve=interpolate.Curve, Distance=negative_3, Corners=1)
boundary_surfaces = BoundarySurfaces(Edges=merge_3)
boundary_surfaces_2 = BoundarySurfaces(Edges=merge_2)
unit_z = UnitZ(Factor=Slider(2.28, range=0..10))
unit_z_2 = UnitZ(Factor=Slider(2.28, range=0..10))
merge_4 = Merge(Data1=flatten(offset_curve_3), Data2=flatten(circle_2))
extrude = Extrude(Base=boundary_surfaces, Direction=unit_z)
extrude_2 = Extrude(Base=boundary_surfaces_2, Direction=unit_z_2)
boundary_surfaces_3 = BoundarySurfaces(Edges=merge_4)
unit_z_3 = UnitZ(Factor=Slider(1.66, range=0..10))
extrude_3 = Extrude(Base=boundary_surfaces_3, Direction=unit_z_3)
