# Grasshopper definition Week 1 - Trees.ghx (Grasshopper 1.0.8)

pt = Point([<point referenced from the Rhino model> x8])
lng = ListLength(List=pt)
dom = ConstructDomain(DomainStart=Slider(17.514, range=1..40), DomainEnd=Slider(40, range=1..40))
random = Random(Range=dom, Number=lng, Seed=2)
graft = GraftTree(Tree=pt, IncludeEmptyLists=True, IncludeNullItems=True)
graft_2 = GraftTree(Tree=random, IncludeEmptyLists=True, IncludeNullItems=True)
multiplication = Multiplication(A=graft_2, B=Slider(0.285, range=0..1))
circle = CircleCNR(Center=graft, Normal=Vector(0, 0, 1), Radius=graft_2)
circle_2 = CircleCNR(Center=graft, Normal=Vector(0, 0, 1), Radius=multiplication)
eval = EvaluateCurve(Curve=reparameterize(circle), Parameter=[Slider(0.843, range=0..1), Slider(1, range=0..1)])  # -> Point, Tangent, Angle
lng_2 = ListLength(List=pt)
ln = Line(StartPoint=graft, EndPoint=eval.Point)
trim = TrimWithRegions(Curve=ln, Regions=circle_2)  # -> Inside, Outside
random_2 = Random(Range="360", Number=lng_2, Seed="43729")
graft_3 = GraftTree(Tree=random_2, IncludeEmptyLists=True, IncludeNullItems=True)
panel = Panel(random_2)
crv = Curve(trim.Outside)
pshift = ShiftPaths(Data=crv, Offset="-1")
rotate = Rotate(Geometry=pshift, Angle=degrees(graft_3), Plane=graft)  # -> Geometry, Transform
