# Grasshopper definition Week 11 - Dome Hut Trial 1, 2, 3 (updated).ghx (Grasshopper 1.0.8)
# plug-ins: Kangaroo2 Components

number_slider = Slider(5000, range=0..10000)
rectangle = Rectangle(Plane=PlaneXY(0, 0, 0), XSize=Slider(42, range=0..100), YSize=Slider(14, range=0..100), Radius=0)  # -> Rectangle, Length
rectangle_2 = Rectangle(Plane=PlaneXY(0, 0, 0), XSize=number_slider, YSize=number_slider, Radius=0)  # -> Rectangle, Length
populate_2d = Populate2D(Region=rectangle.Rectangle, Count=Slider(11, range=0..100), Seed=1)
construct_domain = ConstructDomain(DomainStart=Slider(0.48, range=0..1), DomainEnd=Slider(2.11, range=0..10))
gene_pool = GenePool(Decimals=1, Maximum=5000, Minimum=0, Value=[2248.7, 1875.7, 1663.3, 882.3, 1440.1, 714.9, 1551.7, 1094.9, 1443.6, 767.3])
list_length = ListLength(List=populate_2d)
populate_2d_2 = Populate2D(Region=rectangle_2.Rectangle, Count=Slider(10, range=0..100), Seed=Slider(5, range=0..100))
random = Random(Range=list_length, Number=construct_domain, Seed=2)
circle = Circle(Plane=populate_2d, Radius=random)
region_union = RegionUnion(Curves=circle)
sphere = Sphere(Base=populate_2d_2, Radius=gene_pool)
construct_point = ConstructPoint(XCoordinate=0, YCoordinate=0, ZCoordinate=Slider(-1200, range=-1200..2000))
boundary_surfaces = BoundarySurfaces(Edges=region_union)
solid_union = SolidUnion(Breps=sphere)
xy_plane = XYPlane(Origin=construct_point)
number_slider_2 = Slider(572, range=0..1000)
brep_plane = BrepPlane(Brep=solid_union, Plane=xy_plane)  # -> Curves, Points
mesh = Mesh(boundary_surfaces)
surface = Surface()
split_brep = SplitBrep(Brep=solid_union)
populate_geometry = PopulateGeometry(Geometry=surface, Count=Slider(100, range=0..100), Seed=1)
box = Box({Plane=PlaneXY(-13.65552294, -15.8579061, 0), X=Domain(0, 76.36214991), Y=Domain(0, 42.57358784), Z=Domain(0, 17.55265525)})
list_item = ListItem(List=split_brep, Index="0", Wrap=True)
facet_dome = FacetDome(Points=populate_geometry, Box=box, Radius=Slider(10, range=0..10))  # -> Pattern, Dome
triremesh = TriRemesh(Geometry=list_item, Length=Slider(29, range=0..500), Iterations=25)  # -> Triangulation, Dual, Creases
nakedvertices = NakedVertices(Mesh=mesh)  # -> ClothedIndex, NakedIndex, flatten(ClothedPts), flatten(NakedPts)
edgelengths = EdgeLengths(Mesh=mesh, LengthFactor=Slider(0.8, range=0..1), Strength=1)  # -> flatten(EL)
unit_z = UnitZ(Factor=1)
show = Show(G=mesh)
pull_curve = PullCurve(Curve=facet_dome.Pattern, Surface=surface)
explode = Explode(Curve=pull_curve, Recursive=True)  # -> Segments, Vertices
anchor = Anchor(Point=nakedvertices.NakedPts, Strength=10000)
load = Load(Point=nakedvertices.ClothedPts, ForceVector=unit_z, Weighting=1)
list_item_2 = ListItem(List=sphere, Index=Slider(5, range=0..10), Wrap=True)
qrmesh = QuadRemesh(Mesh=triremesh.Triangulation, Settings={aqc=True, as=50, dhe=True, gci=0, null=False, pme=0, sa=0, tqc=2000})
mesh_2 = Mesh(triremesh.Triangulation)
volume = Volume(Geometry=list_item_2)  # -> Volume, Centroid
face_boundaries = FaceBoundaries(Mesh=qrmesh)
polyline = PolyLine(Vertices=explode.Vertices, Closed=Toggle(True))  # -> flatten(Polyline)
solver = Solver(GoalObjects=[load, show, edgelengths, anchor], Reset=Button(), Threshold=1e-15, Tolerance=0.0001, On=Toggle(True))  # -> I, V, O
number_slider_3 = Slider(0.92, range=0..1)
number_slider_4 = Slider(0.58, range=0..1)
polygon_center = PolygonCenter(Polyline=face_boundaries)  # -> CenterV, CenterE, CenterA
explode_tree = ExplodeTree(Data=solver.O)  # -> Branch0, _0000
distance = Distance(PointA=polygon_center.CenterV, PointB=volume.Centroid)
discontinuity = Discontinuity(Curve=polyline, Level=1)  # -> Points, Parameters
mesh_3 = Mesh(explode_tree.Branch0)
construct_domain_2 = ConstructDomain(DomainStart=number_slider_3, DomainEnd=number_slider_4)
bounds = Bounds(Numbers=distance)
circle_fit = CircleFit(Points=discontinuity.Points)  # -> Circle, Radius, Deviation
weave = Weave(Pattern=mesh_3, NullGaps=False)
remap_numbers = RemapNumbers(Value=distance, Source=bounds, Target=construct_domain_2)  # -> Mapped, Clipped
scale = Scale(Geometry=face_boundaries, Center=polygon_center.CenterV, Factor=remap_numbers.Mapped)  # -> Geometry, Transform
gradient = Gradient(
    LowerLimit=number_slider_3,
    UpperLimit=number_slider_4,
    Parameter=remap_numbers.Mapped,
    stops=[0.15: RGB(255, 130, 160), 0.85: RGB(220, 0, 40)])
ruled_surface = RuledSurface(CurveA=face_boundaries, CurveB=scale.Geometry)
custom_preview = CustomPreview(Geometry=ruled_surface, Material=gradient)
