# Grasshopper definition Week 2 - Python.ghx (Grasshopper 1.0.8)
# plug-ins: RhinoCodePluginGH

# ---- group: Number Slider
number_slider = Slider(10, range=0..10)
curve = Curve(<curve referenced from the Rhino model>)
curve_2 = Curve(<curve referenced from the Rhino model>)

# ----
panel = Panel("""0
1""")

# ---- group: Dispatch Curve
divide_curve = DivideCurve(Curve=curve, Count=number_slider, Kinks=False)  # -> Points, Tangents, Parameters
divide_curve_2 = DivideCurve(Curve=curve_2, Count=number_slider, Kinks=False)  # -> Points, Tangents, Parameters

# ---- group: Dispatch
dispatch = Dispatch(List=divide_curve.Points, DispatchPattern=panel)  # -> ListA, ListB
dispatch_2 = Dispatch(List=divide_curve_2.Points, DispatchPattern=panel)  # -> ListA, ListB

# ----
ironpython_2_script = IronPython2Script(topFlange=curve_2, bottomFlange=curve)  # -> out, trussWebs; inputs topFlange: Curve, bottomFlange: Curve
# ---------- ironpython_2_script: IronPython ----------
import ghpythonlib.components as ghc

#Point A
trussDivision = 10

#Point B
topPoints =     ghc.DivideCurve(topFlange, trussDivision, False)
bottomPoints =  ghc.DivideCurve(bottomFlange, trussDivision, False)

#Point C
topPoints =     ghc.Dispatch(topPoints["points"],[False,True])
bottomPoints =  ghc.Dispatch(bottomPoints["points"],[False,True])
#print(topPoints)

#Point D
trussPoints = ghc.Weave([0,1],bottomPoints["list_b"],topPoints["list_a"])
print(trussPoints)

trussWebs = ghc.PolyLine(trussPoints,False)
# ---------- end ironpython_2_script ----------
python_3_script = Python3Script(topFlange=curve_2, bottonFlange=curve)  # -> out, a; inputs topFlange: Curve
# ---------- python_3_script: Python ----------
# Defining Variables
string = "text"
interger = 1
floatNumber = 1.0
array = [0,1,2,3]
dictionary = {"architect":"An architect is a person who plans, designs, and oversees the construction of buildings. To practice architecture means to provide services in connection with the design of buildings and the space within the site surrounding the buildings that have human occupancy or use as their principal purpose."}
complexDictionary = {"a":[0,1,{"b":[4387,3442,53,45]}]}
#-----------------------------------------
######################################################

import rhinoscriptsyntax as rs
import ghpythonlib.components as ghc

trussDivision = 10

topPoints = ghc.DivideCurve(topFlange, trussDivision, False) # This is division

print(topPoints)

#ghc.DivideCurve()
print(topFlange)
# ---------- end python_3_script ----------
python_3_script_2 = Python3Script(topFlange=curve_2, bottomFlange=curve)  # -> out, trussWebs; inputs topFlange: Curve, bottomFlange: Curve; same code as ironpython_2_script
point = Point(dispatch_2.ListA)
point_2 = Point(dispatch.ListB)
line = Line(StartPoint=divide_curve_2.Points, EndPoint=divide_curve.Points)
weave = Weave(Pattern=panel, Stream0=point_2, Stream1=point, NullGaps=False)
panel_2 = Panel(ironpython_2_script.trussWebs)
panel_3 = Panel(python_3_script_2.trussWebs)
curve_3 = Curve(ironpython_2_script.trussWebs)
curve_4 = Curve(python_3_script_2.trussWebs)
polyline = PolyLine(Vertices=weave, Closed=False)
