# Grasshopper definition Week 2 - Stairs.ghx (Grasshopper 1.0.8)

construct_domain = ConstructDomain(DomainStart=Slider(0, range=0..10), DomainEnd=Slider(10, range=0..10))
range = Range(Domain=construct_domain, Steps=expr("x-1", "10"))
series = Series(Start="5", Step="5", Count="10")
shortest_list = ShortestList(ListA=series, ListB=range, TrimMode=2)  # -> ListA, ListB
list_item = ListItem(List=range, Index="0", Wrap=True)  # -> Item, Item1
subtraction = Subtraction(A=list_item.Item1, B=list_item.Item)
panel = Panel(series)
construct_point = ConstructPoint(XCoordinate=shortest_list.ListA, YCoordinate=0, ZCoordinate=shortest_list.ListB)
unit_z = UnitZ(Factor=subtraction)
panel_2 = Panel(subtraction)
move = Move(Geometry=construct_point, Motion=unit_z)  # -> Geometry, Transform
panel_3 = Panel(unit_z)
panel_4 = Panel("""0
1""")
weave = Weave(Pattern=panel_4, Stream0=construct_point, Stream1=move.Geometry, NullGaps=False)
panel_5 = Panel("""-1
-2""")
point_list = PointList(Points=weave, Size=Slider(0.579, range=0..1))
point_order = PointOrder(Points=weave)
cull_index = CullIndex(List=weave, Indices=panel_5, Wrap=True)
polyline = PolyLine(Vertices=cull_index, Closed=False)
