# Grasshopper definition Week 3 - Spiral Stairs updated.ghx (Grasshopper 1.0.8)

number_slider = Slider(5.72, range=0..100)
number_slider_2 = Slider(4.817, range=0..100)
addition = Addition(A=number_slider_2, B=number_slider)
construct_point = ConstructPoint(XCoordinate=0, YCoordinate=0, ZCoordinate=0)
unit_z = UnitZ(Factor=1)
construct_point_2 = ConstructPoint(XCoordinate=number_slider_2, YCoordinate=0, ZCoordinate=0)
construct_point_3 = ConstructPoint(XCoordinate=0, YCoordinate=0, ZCoordinate=0)
unit_x = UnitX(Factor=1)
circle_cnr = CircleCNR(Center=construct_point, Normal=Vector(0, 0, 1), Radius=number_slider_2)
circle_cnr_2 = CircleCNR(Center=construct_point, Normal=Vector(0, 0, 1), Radius=addition)
line_sdl = LineSDL(Start=construct_point_2, Direction=unit_x, Length=number_slider)
line_sdl_2 = LineSDL(Start=construct_point_3, Direction=unit_z, Length=1)
radians = Radians(Degrees=Slider(0.794, range=0..1))
radians_2 = Radians(Degrees=Slider(0.25, range=0..1))
construct_domain = ConstructDomain(DomainStart=radians, DomainEnd=radians_2)
revolution = Revolution(Curve=line_sdl, Axis=line_sdl_2, Domain=construct_domain)
number_slider_3 = Slider(2371.594, range=0..10000)
construct_domain_2 = ConstructDomain(DomainStart=Slider(0, range=0..1), DomainEnd=number_slider_3)
division = Division(A=number_slider_3, B=Slider(20, range=0..20))
construct_point_4 = ConstructPoint(XCoordinate=Slider(1104.438, range=0..5000), YCoordinate=0, ZCoordinate=0)
range = Range(Domain=construct_domain_2, Steps=division)
xy_plane = XYPlane(Origin=Point(0, 0, 0))
panel = Panel(range)
unit_z_2 = UnitZ(Factor=range)
rotate = Rotate(Geometry=construct_point_4, Angle=degrees(range), Plane=xy_plane)  # -> Geometry, Transform
repeat_data = RepeatData(Data="300", Length="10")
move = Move(Geometry=rotate.Geometry, Motion=unit_z_2)  # -> Geometry, Transform
merge = Merge(Data1=flatten(repeat_data), Data2=flatten("1000"))
repeat_data_2 = RepeatData(Data=merge, Length=Slider(75, range=0..100))
interpolate = Interpolate(Vertices=rotate.Geometry, Degree=3, Periodic=False, KnotStyle=1)  # -> Curve, Length, Domain
mass_addition = MassAddition(Input=repeat_data_2)  # -> Result, PartialResults
length = Length(Curve=interpolate.Curve)
division_2 = Division(A=mass_addition.PartialResults, B=length)
shatter = Shatter(Curve=reparameterize(interpolate.Curve), Parameters=division_2)
panel_2 = Panel(mass_addition.PartialResults)
cull_index = CullIndex(List=shatter, Indices="-1", Wrap=True)
scale = Scale(Geometry=cull_index, Center=Point(0, 0, 0), Factor=Slider(2.04, range=0..10))  # -> Geometry, Transform
ruled_surface = RuledSurface(CurveA=cull_index, CurveB=scale.Geometry)
list_length = ListLength(List=ruled_surface)
geometry = Geometry([<extrusion referenced from the Rhino model> x3])
series = Series(Start="150", Step="150", Count=list_length)
panel_3 = Panel("""0
0
0
0
0
0
0
0
0
0
1""")
xy_plane_2 = XYPlane(Origin=Point(0, 0, 0))
group = Group(Objects=geometry)
unit_z_3 = UnitZ(Factor=series)
move_2 = Move(Geometry=cull_index, Motion=unit_z_3)  # -> Geometry, Transform
curve = Curve(move_2.Geometry)
horizontal_frame = HorizontalFrame(Curve=reparameterize(curve), Parameter="0.5")
panel_4 = Panel(series)
dispatch = Dispatch(List=horizontal_frame, DispatchPattern=panel_3)  # -> ListA, ListB
align_plane = AlignPlane()  # -> Plane, Angle
move_3 = Move(Geometry=ruled_surface, Motion=unit_z_3)  # -> Geometry, Transform
orient = Orient(Geometry=group, Source=xy_plane_2, Target=dispatch.ListB)  # -> Geometry, Transform
bounding_box = BoundingBox(Content=group, Plane=PlaneXY(0, 0, 0))  # -> Box, Box_2
bounding_box_2 = BoundingBox(Content=group, Plane=align_plane.Plane)  # -> Box, Box_2
surface_box = SurfaceBox(Surface=move_3.Geometry, Domain=move_3.Geometry, Height=Slider(100, range=0..100))
box_morph = BoxMorph(Geometry=group, Reference=bounding_box.Box, Target=surface_box)
