# Grasshopper definition Week 3 - Stairs.ghx (Grasshopper 1.0.8)

number_slider = Slider(10, range=0..10)
construct_domain = ConstructDomain(DomainStart=Slider(0, range=0..10), DomainEnd=number_slider)
range = Range(Domain=construct_domain, Steps=expr("x-1", "30"))
series = Series(Start="5", Step="5", Count="30")
shortest_list = ShortestList(ListListA=series, ListListB=range, TrimMode=2)  # -> ListListA, ListListB
list_item = ListItem(List=range, Index="0", Wrap=True)  # -> Item, Item1
subtraction = Subtraction(A=list_item.Item1, B=list_item.Item)
panel = Panel(series)
construct_point = ConstructPoint(XCoordinate=shortest_list.ListListA, YCoordinate=shortest_list.ListListB, ZCoordinate=0)
panel_2 = Panel(subtraction)
unit_z = UnitZ(Factor=subtraction)
unit_y = UnitY(Factor=subtraction)
move = Move(Geometry=construct_point, Motion=unit_y)  # -> Geometry, Transform
panel_3 = Panel(unit_z)
panel_4 = Panel("""0
1""")
weave = Weave(Pattern=panel_4, Stream0=construct_point, Stream1=move.Geometry, NullGaps=False)
panel_5 = Panel("""-1
-2""")
point_list = PointList(Points=weave, Size=Slider(0.784, range=0..1))
point_order = PointOrder(Points=weave)
curve = Curve()
cull_index = CullIndex(List=weave, Indices=panel_5, Wrap=True)
bounding_box = BoundingBox(Content=cull_index, Plane=PlaneXY(0, 0, 0), UnionBox=True)  # -> Box, Box_2
explode = Explode(Curve=curve, Recursive=True)  # -> Segments, Vertices
polyline = PolyLine(Vertices=cull_index, Closed=False)
deconstruct_box = DeconstructBox(Box=bounding_box.Box)  # -> Plane, X, Y, Z
number_slider_2 = Slider(5.734, range=0..20)
plane_surface = PlaneSurface(Plane=deconstruct_box.Plane, XSize=deconstruct_box.X, YSize=deconstruct_box.Y)
surface = Surface(plane_surface)
surface_closest_point = SurfaceClosestPoint(Point=cull_index, Surface=reparameterize(surface))  # -> Point, UVPoint, Distance
md_slider = MDSlider(
    SliderMode=0,
    slider_value=Point(0.567199707, 0.7802940927, 0.5),
    x_domain=Domain(0, 1),
    y_domain=Domain(0, 1),
    z_domain=Domain(0, 1))
unit_z_2 = UnitZ(Factor=number_slider)
point = Point(<point referenced from the Rhino model>)
panel_6 = Panel(bounding_box.Box)
deconstruct = Deconstruct(Point=surface_closest_point.UVPoint)  # -> XComponent, YComponent, ZComponent
curve_2 = Curve(<curve referenced from the Rhino model>)
curve_3 = Curve(<curve referenced from the Rhino model>)
panel_7 = Panel(md_slider)
extrude = Extrude(Base=curve_2, Direction=unit_z_2)
surface_closest_point_2 = SurfaceClosestPoint(Point=point, Surface=reparameterize(extrude))  # -> Point, UVPoint, Distance
extrude_2 = Extrude(Base=curve_3, Direction=unit_z_2)
line = Line(StartPoint=point, EndPoint=surface_closest_point_2.Point)
subtraction_2 = Subtraction(A="1", B=deconstruct.YComponent)
construct_point_2 = ConstructPoint(XCoordinate=deconstruct.YComponent, YCoordinate=deconstruct.XComponent, ZCoordinate=0)
evaluate_surface = EvaluateSurface(Surface=reparameterize(extrude_2), Point=construct_point_2)  # -> Point, Normal, UDirection, VDirection, Frame
evaluate_surface_2 = EvaluateSurface(Surface=reparameterize(extrude), Point=construct_point_2)  # -> Point, Normal, UDirection, VDirection, Frame
polyline_2 = PolyLine(Vertices=evaluate_surface.Point, Closed=False)
polyline_3 = PolyLine(Vertices=evaluate_surface_2.Point, Closed=False)
pull_curve = PullCurve(Curve=polyline_3, Surface=extrude)
pull_curve_2 = PullCurve(Curve=polyline_2, Surface=extrude_2)
loft = Loft(
    Curves=[pull_curve_2, pull_curve],
    Options={Adjust=False, Closed=False, LoftEnds=0, LoftSimp=0, LoftType=0, Rebuild=10, Refit=0.01})
