# Grasshopper definition Week 4 - Trial 1 with landing.ghx (Grasshopper 1.0.8)

number_slider = Slider(23, range=0..100)
number_slider_2 = Slider(35, range=0..50)
curve = Curve(<curve referenced from the Rhino model>)
number_slider_3 = Slider(3, range=0..10)
polygon = Polygon(Plane=PlaneXY(0, 0, 0), Radius=3, Segments=6, FilletRadius=0)  # -> Polygon, Length
divide_curve = DivideCurve(Curve=curve, Count=number_slider_2, Kinks=False)  # -> Points, Tangents, Parameters
series = Series(Start=Slider(12, range=0..100), Step=1, Count=Slider(4, range=0..10))
cull_index = CullIndex(List=curve, Indices=series, Wrap=True)
construct_domain = ConstructDomain(DomainStart=expr("-x", number_slider_3), DomainEnd=number_slider_3)
xz_plane = XZPlane(Origin=divide_curve.Points)
polygon_edge = PolygonEdge(Segments=6)  # -> Polygon, Centre, CornerRadius, EdgeRadius
series_2 = Series(Start=0, Step=Slider(8, range=0..10), Count=number_slider_2)
polygon_2 = Polygon(Plane=xz_plane, Radius=construct_domain, Segments=construct_domain, FilletRadius=0)  # -> Polygon, Length
rotate = Rotate(Geometry=polygon_2.Polygon, Angle=degrees(series_2), Plane=xz_plane)  # -> Geometry, Transform
explode = Explode(Curve=rotate.Geometry, Recursive=True)  # -> Segments, Vertices
cull_index_2 = CullIndex(List=explode.Segments, Indices=Slider(5, range=0..20), Wrap=True)
join_curves = JoinCurves(Curves=cull_index_2, Preserve=False)
fillet = Fillet(Curve=join_curves, Radius=Slider(1, range=1..10))
xz_plane_2 = XZPlane(Origin=Point(0, 0, 0))
number_slider_4 = Slider(4, range=0..10)
offset_curve = OffsetCurve(Curve=fillet, Distance=Slider(0.3, range=0..1), Plane=xz_plane_2, Corners=1)
ruled_surface = RuledSurface(CurveA=fillet, CurveB=offset_curve)
repeat_data = RepeatData(Data=Slider(0, range=0..100), Length=Slider(12, range=0..100))
repeat_data_2 = RepeatData(Data=Slider(1, range=0..1), Length=number_slider_4)
unit_y = UnitY(Factor=Slider(1.2, range=0..10))
merge = Merge(Data1=flatten(repeat_data), Data2=flatten(repeat_data_2))
dispatch = Dispatch(List=flatten(ruled_surface), DispatchPattern=merge)  # -> ListA, ListB
move = Move(Geometry=ruled_surface, Motion=unit_y)  # -> Geometry, Transform
partition_list = PartitionList(List=dispatch.ListA, Size=number_slider_4)
list_item = ListItem(List=partition_list, Index=0, Wrap=True)
move_2 = Move(Geometry=list_item, Motion=unit_y)  # -> Geometry, Transform
extrude = Extrude(Base=dispatch.ListB, Direction=unit_y)
merge_2 = Merge(Data1=move.Geometry, Data2=ruled_surface)
merge_3 = Merge(Data1=move_2.Geometry, Data2=partition_list)
loft = Loft(Curves=merge_3, Options={Adjust=False, Closed=False, LoftEnds=0, LoftSimp=0, LoftType=0, Rebuild=100, Refit=0.01})
custom_preview = CustomPreview(Geometry=[extrude, loft], Material=ColourSwatch(SwatchColor=RGB(255, 255, 255)))
