# Grasshopper definition Week 4 - Trial 1.ghx (Grasshopper 1.0.8)

number_slider = Slider(35, range=0..50)
curve = Curve(<curve referenced from the Rhino model>)
number_slider_2 = Slider(3, range=0..10)
divide_curve = DivideCurve(Curve=curve, Count=number_slider, Kinks=False)  # -> Points, Tangents, Parameters
construct_domain = ConstructDomain(DomainStart=expr("-x", number_slider_2), DomainEnd=number_slider_2)
xz_plane = XZPlane(Origin=divide_curve.Points)
polygon_edge = PolygonEdge(Segments=6)  # -> Polygon, Centre, CornerRadius, EdgeRadius
series = Series(Start=0, Step=Slider(5, range=0..10), Count=number_slider)
polygon = Polygon(Plane=xz_plane, Radius=construct_domain, Segments=construct_domain, FilletRadius=0)  # -> Polygon, Length
rotate = Rotate(Geometry=polygon.Polygon, Angle=degrees(series), Plane=xz_plane)  # -> Geometry, Transform
explode = Explode(Curve=rotate.Geometry, Recursive=True)  # -> Segments, Vertices
cull_index = CullIndex(List=explode.Segments, Indices=Slider(5, range=0..20), Wrap=True)
join_curves = JoinCurves(Curves=cull_index, Preserve=False)
fillet = Fillet(Curve=join_curves, Radius=Slider(1, range=1..10))
xz_plane_2 = XZPlane(Origin=Point(0, 0, 0))
offset_curve = OffsetCurve(Curve=fillet, Distance=Slider(0.3, range=0..1), Plane=xz_plane_2, Corners=1)
edge_surface = EdgeSurface(CurveA=fillet, CurveB=offset_curve)
unit_y = UnitY(Factor=Slider(1.2, range=0..10))
extrude = Extrude(Base=edge_surface, Direction=unit_y)
custom_preview = CustomPreview(Geometry=extrude, Material=ColourSwatch(SwatchColor=RGB(255, 255, 255)))
