# Grasshopper definition Week 5 - Bycicle Wheel Roof.ghx (Grasshopper 1.0.8)

number_slider = Slider(300, range=50..300)
merge = Merge(Data1=Slider(700, range=700..5000), Data2=Slider(5000, range=700..5000))
cir = Circle(Plane=PlaneXY(0, 0, 0), Radius=merge)
item = ListItem(List=cir, Index=0, Wrap=True)  # -> Item, Item1
divide = DivideCurve(Curve=item.Item1, Count=Slider(24, range=0..100), Kinks=False)  # -> Points, Tangents, Parameters
neg = Negative(Value=number_slider)
tan = TangentLines(Point=divide.Points, Circle=item.Item)  # -> Tangent1, Tangent2
Z = UnitZ(Factor=[neg, number_slider])
end = EndPoints(Curve=tan.Tangent1)  # -> Start, End
end_2 = EndPoints(Curve=tan.Tangent2)  # -> Start, End
move = Move(Geometry=graft(item.Item), Motion=Z)  # -> Geometry, Transform
move_2 = Move(Geometry=graft(end.End), Motion=Z)  # -> Geometry, Transform
move_3 = Move(Geometry=graft(end_2.End), Motion=Z)  # -> Geometry, Transform
ins = InsertItems(List=move_2.Geometry, Item=graft(divide.Points), Indices="0", Wrap=True)
ins_2 = InsertItems(List=move_3.Geometry, Item=graft(divide.Points), Indices="0", Wrap=True)
item_2 = ListItem(List=move_2.Geometry, Index=0, Wrap=True)  # -> Item, Item1
item_3 = ListItem(List=move_3.Geometry, Index=0, Wrap=True)  # -> Item, Item1
item_4 = ListItem(List=ins, Index=0, Wrap=True)  # -> Item, Item1, Item2
item_5 = ListItem(List=ins_2, Index=0, Wrap=True)  # -> Item, Item1, Item2
merge_2 = Merge(Data1=item_2.Item, Data2=item_3.Item)  # -> flatten(Result)
merge_3 = Merge(Data1=item_2.Item1, Data2=item_3.Item1)  # -> flatten(Result)
item_6 = ListItem(List=move.Geometry, Index=0, Wrap=True)  # -> Item, Item1
srf4pt = _4PointSurface(CornerA=item_5.Item, CornerB=item_5.Item1, CornerC=item_5.Item2)  # -> flatten(Surface)
srf4pt_2 = _4PointSurface(CornerA=item_4.Item, CornerB=item_4.Item1, CornerC=item_4.Item2)
alongcrv = SortAlongCurve(Points=merge_3, Curve=item_6.Item1)  # -> Points, Indices
alongcrv_2 = SortAlongCurve(Points=merge_2, Curve=item_6.Item)  # -> Points, Indices
pline = PolyLine(Vertices=divide.Points, Closed=invert(False))
pline_2 = PolyLine(Vertices=alongcrv_2.Points, Closed=invert(False))
pline_3 = PolyLine(Vertices=alongcrv.Points, Closed=invert(False))
bbx = BrepBrep(BrepA=srf4pt_2, BrepB=srf4pt)  # -> flatten(Curves), Points
ln = Line(StartPoint=move_2.Geometry, EndPoint=graft(divide.Points))
ln_2 = Line(StartPoint=move_3.Geometry, EndPoint=graft(divide.Points))
pipe = Pipe(Curve=flatten([ln_2, pline, pline_2, pline_3, ln, bbx.Curves]), Radius=Slider(22, range=5..50), Caps=0)
