# Grasshopper definition Week 5 - Clock Face.ghx (Grasshopper 1.0.8)

number_slider = Slider(360, range=0..360)
radius = Slider(10, range=0..10)
radius_2 = Slider(6, range=0..10)
construct_point = ConstructPoint(XCoordinate=Slider(18.155, range=0..100), YCoordinate=0, ZCoordinate=0)
number_slider_2 = Slider(5000, range=300..5000)
number_slider_3 = Slider(6, range=0..100)
number_slider_4 = Slider(26, range=0..100)
radius_3 = Slider(10, range=0..10)
circle = Circle(Plane=construct_point, Radius=radius_2)
length = Length(Curve=circle)
division = Division(A=number_slider_2, B=Slider(1.21, range=0..10))
pi = Pi(Factor="2")
modulus = Modulus(A=number_slider_3, B=Slider(9, range=0..100))
circle_2 = Circle(Plane=PlaneXY(0, 0, 0), Radius=number_slider_2)
division_2 = Division(A=radius_3, B=Slider(1.221, range=0..5))
modulus_2 = Modulus(A=length, B=Slider(20, range=0..100))
division_3 = Division(A=radius_2, B=Slider(1.221, range=0..5))
construct_point_2 = ConstructPoint(XCoordinate="0", YCoordinate="0", ZCoordinate="0")
circle_3 = Circle(Plane=PlaneXY(0, 0, 0), Radius=division)
modulus_3 = Modulus(A=number_slider_4, B=Slider(13, range=0..100))
circle_4 = Circle(Plane=PlaneXY(0, 0, 0), Radius=radius_3)
addition = Addition(A=number_slider_3, B=modulus)
integer = Integer(addition)
circle_5 = Circle(Plane=PlaneXY(0, 0, 0), Radius=division_2)
integer_2 = Integer(modulus_2)
circle_6 = Circle(Plane=construct_point, Radius=division_3)
division_4 = Division(A=pi, B="60")
addition_2 = Addition(A=number_slider_4, B=modulus_3)
integer_3 = Integer(addition_2)
divide_curve = DivideCurve(Curve=circle_2, Count=addition, Kinks=False)  # -> Points, Tangents, Parameters
degrees = Degrees(Radians=division_4)
pi_2 = Pi(Factor=2)
division_5 = Division(A=pi_2, B=addition)
trigger = Trigger(Interval=1000, TimerInterval=1000, Target=data_recorder)
divide_curve_2 = DivideCurve(Curve=circle_4, Count=addition_2, Kinks=False)  # -> Points, Tangents, Parameters
divide_curve_3 = DivideCurve(Curve=circle, Count=integer_2, Kinks=False)  # -> Points, Tangents, Parameters
multiplication = Multiplication(A="60", B="12")
pi_3 = Pi(Factor=2)
division_6 = Division(A=pi_3, B=addition_2)
pi_4 = Pi(Factor=2)
division_7 = Division(A=pi_4, B=integer_2)
dispatch = Dispatch(List=divide_curve.Points, DispatchPattern=[True, False])  # -> ListA, ListB
multiplication_2 = Multiplication(A=degrees, B=Slider(2784, range=0..4000))
data_recorder = DataRecorder(degrees, DataLimit=-10, RecordData=True)  # disabled
division_8 = Division(A=data_recorder, B="60")
division_9 = Division(A=data_recorder, B=multiplication)
dispatch_2 = Dispatch(List=divide_curve_2.Points, DispatchPattern=[True, False])  # -> ListA, ListB
dispatch_3 = Dispatch(List=divide_curve_3.Points, DispatchPattern=[True, False])  # -> ListA, ListB
mass_addition = MassAddition(Input=division_8)  # -> Result, PartialResults
mass_addition_2 = MassAddition(Input=division_9)  # -> Result, PartialResults
line = Line(StartPoint=dispatch.ListA, EndPoint=dispatch.ListB)
mass_addition_3 = MassAddition(Input=data_recorder)  # -> Result, PartialResults
line_2 = Line(StartPoint=dispatch_2.ListA, EndPoint=dispatch_2.ListB)
line_3 = Line(StartPoint=dispatch_3.ListA, EndPoint=dispatch_3.ListB)
multiplication_3 = Multiplication(A=mass_addition.Result, B="-1")
multiplication_4 = Multiplication(A=mass_addition_2.Result, B="-1")
unit_z = UnitZ(Factor=1)
pi_5 = Pi(Factor=-0.5)
vector = Vector(line)
concatenate = Concatenate(FragmentA=mass_addition_3.Result, FragmentB="deg.")
unit_z_2 = UnitZ(Factor=1)
pi_6 = Pi(Factor=-0.5)
unit_z_3 = UnitZ(Factor=1)
pi_7 = Pi(Factor=-0.5)
vector_2 = Vector(line_2)
multiplication_5 = Multiplication(A=mass_addition_3.Result, B="-1")
vector_3 = Vector(line_3)
rotate = Rotate(Vector=vector, Axis=unit_z, Angle=pi_5)
rotate_2 = Rotate(Vector=vector_2, Axis=unit_z_2, Angle=pi_6)
rotate_3 = Rotate(Vector=vector_3, Axis=unit_z_3, Angle=pi_7)
panel = Panel(concatenate)
amplitude = Amplitude(Vector=rotate, Amplitude=Slider(449, range=50..1000))
point_polar = PointPolar(
    BasePlane=construct_point_2,
    XYAngle=expr("x+90", degrees(multiplication_5)),
    ZAngle=0,
    Offset=Slider(3408, range=300..5000))
amplitude_2 = Amplitude(Vector=rotate_2, Amplitude=Slider(2, range=0..10))
amplitude_3 = Amplitude(Vector=rotate_3, Amplitude=Slider(2, range=0..10))
point_polar_2 = PointPolar(
    BasePlane=construct_point_2,
    XYAngle=expr("x+90", degrees(multiplication_3)),
    ZAngle=0,
    Offset=Slider(2768, range=300..5000))
point_polar_3 = PointPolar(
    BasePlane=construct_point_2,
    XYAngle=expr("x+90", degrees(multiplication_4)),
    ZAngle=0,
    Offset=Slider(1824, range=300..5000))
panel_2 = Panel(mass_addition_3.Result)
panel_3 = Panel("""35
-35""")
move = Move(Geometry=line, Motion=amplitude)  # -> Geometry, Transform
line_4 = Line(StartPoint=construct_point_2, EndPoint=point_polar)
move_2 = Move(Geometry=line_2, Motion=amplitude_2)  # -> Geometry, Transform
move_3 = Move(Geometry=line_3, Motion=amplitude_3)  # -> Geometry, Transform
line_5 = Line(StartPoint=construct_point_2, EndPoint=point_polar_2)
curve = Curve(line)
line_6 = Line(StartPoint=construct_point_2, EndPoint=point_polar_3)
offset = OffsetCurve(Curve=line_4, Distance=panel_3, Corners=1)  # -> flatten(Curve)
cir = Circle(Plane=construct_point_2, Radius=Slider(150, range=50..1000))
evaluate_length = EvaluateLength(Curve=move.Geometry, Length=0.5, Normalized=True)  # -> Point, Tangent, Parameter
list_length = ListLength(List=line_4)
number_slider_5 = Slider(0.81, range=0..1)
curve_2 = Curve(line_2)
curve_3 = Curve(line_3)
evaluate_length_2 = EvaluateLength(Curve=move_2.Geometry, Length=0.5, Normalized=True)  # -> Point, Tangent, Parameter
evaluate_length_3 = EvaluateLength(Curve=curve, Length=0.5, Normalized=True)  # -> Point, Tangent, Parameter
evaluate_length_4 = EvaluateLength(Curve=move_3.Geometry, Length=0.5, Normalized=True)  # -> Point, Tangent, Parameter
loft = Loft(Curves=offset, Options={Adjust=False, Closed=False, LoftEnds=0, LoftSimp=0, LoftType=0, Rebuild=10, Refit=0.01})
number_slider_6 = Slider(0.73, range=0..1)
number_slider_7 = Slider(0.73, range=0..1)
multiplication_6 = Multiplication(A=list_length, B=Slider(4485, range=1000..5000))
runion = RegionUnion(Curves=[cir, loft])
evaluate_length_5 = EvaluateLength(Curve=curve_2, Length=0.5, Normalized=True)  # -> Point, Tangent, Parameter
evaluate_length_6 = EvaluateLength(Curve=curve_3, Length=0.5, Normalized=True)  # -> Point, Tangent, Parameter
midpt = CurveMiddle(Curve=line_5)
pframe = PerpFrame(Curve=line_5, Parameter="0.5")
boundary = BoundarySurfaces(Edges=runion)
midpt_2 = CurveMiddle(Curve=line_6)
pframe_2 = PerpFrame(Curve=line_6, Parameter="0.5")
deplane = DeconstructPlane(Plane=pframe)  # -> Origin, XAxis, YAxis, ZAxis
circle_7 = Circle(Plane=construct_point_2, Radius=multiplication_6)
deplane_2 = DeconstructPlane(Plane=pframe_2)  # -> Origin, XAxis, YAxis, ZAxis
amp = Amplitude(Vector=deplane.YAxis, Amplitude=Slider(150, range=50..1000))
division_10 = Division(A="1", B=number_slider_5)
amp_2 = Amplitude(Vector=deplane_2.YAxis, Amplitude=Slider(150, range=50..1000))
division_11 = Division(A="1", B=number_slider_6)
scale = Scale(Geometry=move.Geometry, Center=evaluate_length.Point, Factor=number_slider_5)  # -> Geometry, Transform
scale_2 = Scale(Geometry=curve, Center=evaluate_length_3.Point, Factor=division_10)  # -> Geometry, Transform
division_12 = Division(A="1", B=number_slider_7)
move_4 = Move(Geometry=midpt, Motion=amp)  # -> Geometry, Transform
offset_2 = OffsetCurve(Curve=circle_7, Distance=Slider(0.475, range=0..1), Corners=1)
scale_3 = Scale(Geometry=move_2.Geometry, Center=evaluate_length_2.Point, Factor=number_slider_6)  # -> Geometry, Transform
scale_4 = Scale(Geometry=curve_2, Center=evaluate_length_5.Point, Factor=division_11)  # -> Geometry, Transform
move_5 = Move(Geometry=midpt_2, Motion=amp_2)  # -> Geometry, Transform
scale_5 = Scale(Geometry=move_3.Geometry, Center=evaluate_length_4.Point, Factor=number_slider_7)  # -> Geometry, Transform
scale_6 = Scale(Geometry=curve_3, Center=evaluate_length_6.Point, Factor=division_12)  # -> Geometry, Transform
divide_curve_4 = DivideCurve(Curve=offset_2, Count=Slider(12, range=0..100), Kinks=False)  # -> Points, Tangents, Parameters
arc = Arc3Pt(PointA=construct_point_2, PointB=move_4.Geometry, PointC=point_polar_2)  # -> Arc, Plane, Radius
arc_2 = Arc3Pt(PointA=construct_point_2, PointB=move_5.Geometry, PointC=point_polar_3)  # -> Arc, Plane, Radius
mirror = MirrorCurve(Geometry=arc.Arc, Curve=line_5, Tangent=True)
shift_list = ShiftList(List=scale_2.Geometry, Shift=1, Wrap=True)
end_points = EndPoints(Curve=scale_2.Geometry)  # -> Start, End
end_points_2 = EndPoints(Curve=scale.Geometry)  # -> Start, End
shatter = Shatter(Curve=circle_7, Parameters=divide_curve_4.Parameters)
mirror_2 = MirrorCurve(Geometry=arc_2.Arc, Curve=line_6, Tangent=True)
shift_list_2 = ShiftList(List=scale_4.Geometry, Shift=1, Wrap=True)
shift_list_3 = ShiftList(List=scale_6.Geometry, Shift=1, Wrap=True)
end_points_3 = EndPoints(Curve=scale_4.Geometry)  # -> Start, End
end_points_4 = EndPoints(Curve=scale_3.Geometry)  # -> Start, End
boundary_2 = BoundarySurfaces(Edges=[mirror, arc.Arc])
end_points_5 = EndPoints(Curve=scale_6.Geometry)  # -> Start, End
end_points_6 = EndPoints(Curve=scale_5.Geometry)  # -> Start, End
panel_4 = Panel(divide_curve_4.Parameters)
end_points_7 = EndPoints(Curve=shift_list)  # -> Start, End
boundary_3 = BoundarySurfaces(Edges=[mirror_2, arc_2.Arc])
boundary_4 = BoundarySurfaces(Edges=circle_3)
end_points_8 = EndPoints(Curve=shift_list_2)  # -> Start, End
line_7 = Line(StartPoint=end_points_2.Start, EndPoint=end_points.Start)
end_points_9 = EndPoints(Curve=shift_list_3)  # -> Start, End
line_8 = Line(StartPoint=end_points_2.End, EndPoint=end_points.End)
line_9 = Line(StartPoint=end_points_4.Start, EndPoint=end_points_3.Start)
line_10 = Line(StartPoint=end_points_6.Start, EndPoint=end_points_5.Start)
divide_curve_5 = DivideCurve(Curve=shatter, Count="5", Kinks=False)  # -> Points, Tangents, Parameters
shatter_2 = Shatter(Curve=circle_7, Parameters=flatten(divide_curve_5.Parameters))
list_item = ListItem(List=graft(shatter_2), Index=0, Wrap=True)
line_11 = Line(StartPoint=end_points.End, EndPoint=end_points_7.Start)
line_12 = Line(StartPoint=end_points_4.End, EndPoint=end_points_3.End)
panel_5 = Panel("""false
true
true
true
true""")
line_13 = Line(StartPoint=end_points_6.End, EndPoint=end_points_5.End)
Z = UnitZ(Factor=Slider(10, range=10..150))
line_14 = Line(StartPoint=end_points_3.End, EndPoint=end_points_8.Start)
line_15 = Line(StartPoint=end_points_5.End, EndPoint=end_points_9.Start)
divide_curve_6 = DivideCurve(Curve=list_item, Count="60", Kinks=False)  # -> Points, Tangents, Parameters
Z_2 = UnitZ(Factor=Slider(70, range=50..150))
shift_list_4 = ShiftList(List=reverse(divide_curve_4.Points), Shift="-3", Wrap=True)
dispatch_4 = Dispatch(List=divide_curve_5.Points, DispatchPattern=panel_5)  # -> ListA, ListB
extr = Extrude(Base=boundary_4, Direction=Z)
scale_7 = Scale(Geometry=shift_list_4, Center=construct_point_2, Factor=Slider(0.82, range=0..10))  # -> Geometry, Transform
construct_domain = ConstructDomain(DomainStart="1", DomainEnd="12")
merge = Merge(Data1=scale.Geometry, Data2=line_7, Data3=line_8, Data4=line_11)  # -> flatten(Result)
extr_2 = Extrude(Base=[boundary, boundary_2, boundary_3], Direction=Z_2)
merge_2 = Merge(Data1=scale_3.Geometry, Data2=line_9, Data3=line_12, Data4=line_14)  # -> flatten(Result)
merge_3 = Merge(Data1=scale_5.Geometry, Data2=line_10, Data3=line_13, Data4=line_15)  # -> flatten(Result)
number = Number(division_5)
join_curves = JoinCurves(Curves=merge, Preserve=False)
range = Range(Domain=construct_domain, Steps=expr("x-1", "12"))
number_2 = Number(division_6)
number_3 = Number(division_7)
join_curves_2 = JoinCurves(Curves=merge_2, Preserve=False)
division_13 = Division(A=number, B=2)
join_curves_3 = JoinCurves(Curves=merge_3, Preserve=False)
point = Point(dispatch_4.ListB)
division_14 = Division(A=number_2, B=2)
division_15 = Division(A=number_3, B=2)
curve_4 = Curve(circle_3)
point_2 = Point(dispatch_4.ListA)
curve_5 = Curve(circle_5)
text_tag_3d = TextTag3D(Location=shift_list_4, Text=range, Size=Slider(0.6, range=0..10), Justification=5)
curve_6 = Curve(circle_6)
area = Area(Geometry=join_curves_3)  # -> Area, Centroid
move_6 = Move(Geometry=curve_4, Motion=Vector(0, 0, 10))  # -> Geometry, Transform
scale_8 = Scale(Geometry=point_2, Center=construct_point_2, Factor=Slider(0.92, range=0..1))  # -> Geometry, Transform
scale_9 = Scale(Geometry=point, Center=construct_point_2, Factor=Slider(0.922, range=0..1))  # -> Geometry, Transform
rotate_4 = Rotate(Geometry=join_curves, Angle=division_13, Plane=PlaneXY(0, 0, 0))  # -> Geometry, Transform
rotate_5 = Rotate(Geometry=join_curves_2, Angle=division_14, Plane=PlaneXY(0, 0, 0))  # -> Geometry, Transform
rotate_6 = Rotate(Geometry=join_curves_3, Angle=division_15, Plane=area.Centroid)  # -> Geometry, Transform
line_16 = Line(StartPoint=point_2, EndPoint=scale_8.Geometry)
line_17 = Line(StartPoint=point, EndPoint=scale_9.Geometry)
number_4 = Number(Slider(60, range=0..100))
number_5 = Number(Slider(83, range=0..100))
number_6 = Number(Slider(80, range=0..100))
radians = Radians(Degrees=number_4)
rotate_7 = Rotate(Geometry=rotate_4.Geometry, Angle=radians, Plane=PlaneXY(0, 0, 0))  # -> Geometry, Transform
radians_2 = Radians(Degrees=number_5)
rotate_8 = Rotate(Geometry=rotate_5.Geometry, Angle=radians_2, Plane=PlaneXY(0, 0, 0))  # -> Geometry, Transform
radians_3 = Radians(Degrees=number_6)
rotate_9 = Rotate(Geometry=rotate_6.Geometry, Angle=radians_3, Plane=area.Centroid)  # -> Geometry, Transform
number_slider_8 = Slider(150, range=150..300)
integer_4 = Integer(integer_3)
integer_5 = Integer(integer_2)
curve_7 = Curve(rotate_7.Geometry)
area_2 = Area(Geometry=curve_7)  # -> Area, Centroid
curve_8 = Curve(rotate_8.Geometry)
curve_9 = Curve(rotate_9.Geometry)
division_16 = Division(A=integer_4, B=integer_5)
area_3 = Area(Geometry=curve_9)  # -> Area, Centroid
area_4 = Area(Geometry=curve_8)  # -> Area, Centroid
Z_3 = UnitZ(Factor=number_slider_8)
boundary_5 = BoundarySurfaces(Edges=circle_3)
boundary_6 = BoundarySurfaces(Edges=rotate_7.Geometry)
multiplication_7 = Multiplication(A=number_slider, B=division_16)
number_slider_9 = Slider(40, range=5..100)
subtraction = Subtraction(A=number_slider_8, B=number_slider_9)
Z_4 = UnitZ(Factor=subtraction)
move_7 = Move(Geometry=[line_16, line_17], Motion=Z_4)  # -> Geometry, Transform
extr_3 = Extrude(Base=boundary_6, Direction=Z_3)
extr_4 = Extrude(Base=boundary_5, Direction=Z_3)
negative = Negative(Value=multiplication_7)
rotate_10 = Rotate(Geometry=curve_7, Angle=degrees(1.570796327), Plane=area_2.Centroid)  # -> Geometry, Transform
move_8 = Move(Geometry=circle_7, Motion=Z_3)  # -> Geometry, Transform
sdiff = SolidDifference(BrepsA=extr_3, BrepsB=extr_4)
rotate_11 = Rotate(Geometry=curve_8, Angle=degrees(number_slider), Plane=area_4.Centroid)  # -> Geometry, Transform
rotate_12 = Rotate(Geometry=curve_9, Angle=degrees(negative), Plane=area_3.Centroid)  # -> Geometry, Transform
neg = Negative(Value=number_slider_9)
boundary_7 = BoundarySurfaces(Edges=move_8.Geometry)
Z_5 = UnitZ(Factor=neg)
number_slider_10 = Slider(171, range=100..1000)
extr_5 = Extrude(Base=boundary_7, Direction=Z_5)
sdiff_2 = SolidDifference(BrepsA=sdiff, BrepsB=extr_5)
scale_10 = Scale(Geometry=[curve_5, curve_6], Center=Point(0, 0, 0), Factor=number_slider_10)  # -> Geometry, Transform
scale_11 = Scale(Geometry=[rotate_11.Geometry, rotate_12.Geometry], Center=Point(0, 0, 0), Factor=number_slider_10)  # -> Geometry, Transform
boundary_8 = BoundarySurfaces(Edges=scale_11.Geometry)
boundary_9 = BoundarySurfaces(Edges=scale_10.Geometry)
Z_6 = UnitZ(Factor=Slider(60, range=20..100))
Z_7 = UnitZ(Factor=Slider(10, range=10..100))
ma = MassAddition(Input=[Z, Z_7, Z_6])  # -> Result, PartialResults
move_9 = Move(Geometry=extr_2, Motion=ma.Result)  # -> Geometry, Transform
extr_6 = Extrude(Base=boundary_8, Direction=Z_6)
extr_7 = Extrude(Base=boundary_9, Direction=Z_7)
move_10 = Move(Geometry=extr_7, Motion=Z_6)  # -> Geometry, Transform
sunion = SolidUnion(Breps=[move_10.Geometry, extr_6])
move_11 = Move(Geometry=sunion, Motion=Z)  # -> Geometry, Transform
