# Grasshopper definition Week 5 - Clockpunk Stairs - Trial 1.ghx (Grasshopper 1.0.8)
# plug-ins: Kangaroo2 Components

number_slider = Slider(26, range=0..100)
radius = Slider(10, range=0..10)
division = Division(A=radius, B=Slider(3, range=0..10))
modulus = Modulus(A=number_slider)
circle = Circle(Plane=PlaneXY(0, 0, 0), Radius=radius)
circle_2 = Circle(Plane=PlaneXY(0, 0, 0), Radius=division)
addition = Addition(A=number_slider, B=modulus)
pi = Pi(Factor=2)
divide_curve = DivideCurve(Curve=circle, Count=addition, Kinks=False)  # -> Points, Tangents, Parameters
division_2 = Division(A=pi, B=addition)
dispatch = Dispatch(List=divide_curve.Points, DispatchPattern=[True, False])  # -> ListA, ListB
line = Line(StartPoint=dispatch.ListA, EndPoint=dispatch.ListB)
unit_z = UnitZ(Factor=1)
pi_2 = Pi(Factor=-0.5)
vector = Vector(line)
number_slider_2 = Slider(2, range=0..10)
rotate = Rotate(Vector=vector, Axis=unit_z, Angle=pi_2)
amplitude = Amplitude(Vector=rotate, Amplitude=number_slider_2)
move = Move(Geometry=line, Motion=amplitude)  # -> Geometry, Transform
curve = Curve(line)
evaluate_length = EvaluateLength(Curve=move.Geometry, Length=0.5, Normalized=True)  # -> Point, Tangent, Parameter
number_slider_3 = Slider(0.73, range=0..1)
evaluate_length_2 = EvaluateLength(Curve=curve, Length=0.5, Normalized=True)  # -> Point, Tangent, Parameter
division_3 = Division(A="1", B=number_slider_3)
scale = Scale(Geometry=move.Geometry, Center=evaluate_length.Point, Factor=number_slider_3)  # -> Geometry, Transform
scale_2 = Scale(Geometry=curve, Center=evaluate_length_2.Point, Factor=division_3)  # -> Geometry, Transform
shift_list = ShiftList(List=scale_2.Geometry, Shift=1, Wrap=True)
end_points = EndPoints(Curve=scale_2.Geometry)  # -> Start, End
end_points_2 = EndPoints(Curve=scale.Geometry)  # -> Start, End
end_points_3 = EndPoints(Curve=shift_list)  # -> Start, End
line_2 = Line(StartPoint=end_points_2.Start, EndPoint=end_points.Start)
line_3 = Line(StartPoint=end_points_2.End, EndPoint=end_points.End)
line_4 = Line(StartPoint=end_points.End, EndPoint=end_points_3.Start)
merge = Merge(Data1=scale.Geometry, Data2=line_2, Data3=line_3, Data4=line_4)  # -> flatten(Result)
join_curves = JoinCurves(Curves=merge, Preserve=False)
number = Number(division_2)
division_4 = Division(A=number, B=2)
curve_2 = Curve(circle_2)
negative = Negative(Value=division_4)
number_2 = Number(radius)
number_3 = Number(number_slider_2)
rotate_2 = Rotate(Geometry=join_curves, Angle=division_4, Plane=PlaneXY(0, 0, 0))  # -> Geometry, Transform
rotate_3 = Rotate(Geometry=join_curves, Angle=division_4, Plane=PlaneXY(0, 0, 0))  # -> Geometry, Transform
multiplication = Multiplication(A=number_2)
number_slider_4 = Slider(83, range=0..100)
trigger = Trigger(Interval=1000, TimerInterval=1000, Target=number_5)
addition_2 = Addition(A=multiplication, B=number_3)
addition_3 = Addition(A=addition_2, B=Slider(10, range=0..10))
unit_x = UnitX(Factor=addition_3)
move_2 = Move(Geometry=curve_2, Motion=unit_x)  # -> Geometry, Transform
number_4 = Number(Slider(83, range=0..100))  # disabled
move_3 = Move(Geometry=rotate_3.Geometry, Motion=unit_x)  # -> Geometry, Transform
number_5 = Number(number_slider_4)  # disabled
radians = Radians(Degrees=number_slider_4)
rotate_4 = Rotate(Geometry=rotate_2.Geometry, Angle=radians, Plane=PlaneXY(0, 0, 0))  # -> Geometry, Transform
data_recorder = DataRecorder(number_5, DataLimit=-10, RecordData=True)
curve_3 = Curve(move_3.Geometry)
area = Area(Geometry=curve_3)  # -> Area, Centroid
curve_4 = Curve(rotate_4.Geometry)
mass_addition = MassAddition(Input=data_recorder)  # -> Result, PartialResults
rotate_5 = Rotate(Angle=Slider(0.42, range=0..1), Plane=curve_3)  # -> Geometry, Transform
panel = Panel(mass_addition.Result)
curvecollide = CurveCollide(Curves=curve_4, PassiveCurves=rotate_5.Geometry, BasePlane=PlaneXY(0, 0, 0), Strength=1)  # -> Goal, Frames
anchor = Anchor(Point=curvecollide.Frames, Strength=10000)
solver = Solver(GoalObjects=[curvecollide.Goal, anchor], Reset=Button(), Threshold=1e-15, Tolerance=0.0001, On=True)  # -> I, V, O
