# Grasshopper definition Week 5 - Grid.ghx (Grasshopper 1.0.8)

triangular = Triangular(Plane=PlaneXY(0, 0, 0), Size=1, ExtentX=Slider(30, range=0..100), ExtentY=Slider(15, range=0..100))  # -> Cells, Points
point = Point([<point referenced from the Rhino model> x2])
construct_domain = ConstructDomain(DomainStart=Slider(1, range=0..1), DomainEnd=Slider(0.202, range=0..1))
construct_domain_2 = ConstructDomain(DomainStart=Slider(0, range=0..1), DomainEnd=Slider(6.712, range=0..10))
panel = Panel("""0
1""")
flatten_tree = FlattenTree(Tree=triangular.Cells, Path="{0}")
list_item = ListItem(List=flatten_tree, Index=panel, Wrap=True)
explode = Explode(Curve=flatten_tree, Recursive=True)  # -> Segments, Vertices
area = Area(Geometry=flatten_tree)  # -> Area, Centroid
graft_tree = GraftTree(Tree=area.Centroid, IncludeEmptyLists=True, IncludeNullItems=True)
distance = Distance(PointA=graft_tree, PointB=point)
average = Average(Input=distance)
mass_addition = MassAddition(Input=distance)  # -> Result, PartialResults
data = Data(distance)
flatten_tree_2 = FlattenTree(Tree=mass_addition.Result, Path="{0}")
data_2 = Data(flatten_tree_2)
remap_numbers = RemapNumbers(Value=data, Source=construct_domain_2, Target=construct_domain)  # -> Mapped, Clipped
bounds = Bounds(Numbers=flatten_tree_2)
boolean = Boolean(remap_numbers.Clipped)
panel_2 = Panel(mass_addition.Result)
evaluate_length = EvaluateLength(Curve=reparameterize(explode.Segments), Length="0.5", Normalized=True)  # -> Point, Tangent, Parameter
construct_domain_3 = ConstructDomain(DomainStart=Slider(0, range=0..1), DomainEnd=Slider(1, range=0..1))
list_item_2 = ListItem(List=remap_numbers.Mapped, Index=0, Wrap=True)
dispatch = Dispatch(List=remap_numbers.Clipped, DispatchPattern=boolean)  # -> ListA, ListB
number_slider = Slider(0.502, range=0..1)
average_2 = Average(Input=dispatch.ListA)
integer = Integer(0)
line = Line(StartPoint=evaluate_length.Point, EndPoint=graft_tree)
panel_3 = Panel(area.Centroid)
panel_4 = Panel(graft_tree)
panel_5 = Panel(explode.Segments)
replace_nulls = ReplaceNulls(Items=average_2, Replacements=integer)  # -> Items, Count
remap_numbers_2 = RemapNumbers(Value=replace_nulls.Items, Source=Domain(0, 1), Target=construct_domain_3)  # -> Mapped, Clipped
list_item_3 = ListItem(List=remap_numbers_2.Mapped, Index=0, Wrap=True)
populate_2d = Populate2D(Region={Plane=PlaneXY(0, 0, 0), Size=Domain2(u=0..20, v=0..10)}, Count=100, Seed=1)
point_2 = Point(explode.Vertices)
graph_mapper = GraphMapper(
    flatten(list_item_3),
    x0=0,
    x1=1,
    y0=0,
    y1=1,
    container_name="Sine",
    Equation_px=[0, 0.8324107528],
    Equation_py=[0, 0.8246752024])
partition_list = PartitionList(List=populate_2d, Size=populate_2d)
unit_z = UnitZ(Factor=Slider(0.184, range=0..1))
graft_tree_2 = GraftTree(Tree=graph_mapper, IncludeEmptyLists=True, IncludeNullItems=True)
evaluate_length_2 = EvaluateLength(Curve=reparameterize(line), Length=graft_tree_2, Normalized=True)  # -> Point, Tangent, Parameter
weave = Weave(Pattern=[0, 1], Stream0=point_2, Stream1=evaluate_length_2.Point, NullGaps=False)
polyline = PolyLine(Vertices=weave, Closed=False)
voronoi = Voronoi(Points=partition_list, BruteForceOverride=False)
move = Move(Geometry=graft_tree, Motion=unit_z)  # -> Geometry, Transform
extrude_point = ExtrudePoint(Base=polyline, Point=move.Geometry)
panel_6 = Panel(graft_tree_2)
panel_7 = Panel(point_2)
panel_8 = Panel(move.Geometry)
