# Grasshopper definition Week 5 - Spiral Base.ghx (Grasshopper 1.0.8)

vector_xyz = VectorXYZ(XComponent=0, YComponent=0, ZComponent=0)  # -> Vector, Length
unit_y = UnitY(Factor=1)
number_slider = Slider(12, range=6..15)
line_sdl = LineSDL(Start=vector_xyz.Vector, Direction=unit_y, Length=Slider(121, range=0..1000))
unit_x = UnitX(Factor=Slider(0, range=0..100))
multiplication = Multiplication(A=number_slider, B="2")
divide_curve = DivideCurve(Curve=line_sdl, Count=Slider(100, range=0..100), Kinks=False)  # -> Points, Tangents, Parameters
negative = Negative(Value=unit_x)
division = Division(A="360", B=multiplication)
move = Move(Geometry=divide_curve.Points, Motion=negative)  # -> Geometry, Transform
panel = Panel("""0
1""")
list_length = ListLength(List=move.Transform)
subtraction = Subtraction(A=list_length, B="1")
cir = Circle(Plane=PlaneXY(0, 0, 0), Radius=Slider(2484, range=700..5000))
cir_2 = Circle(Plane=cir, Radius=Slider(150, range=50..150))
divide = DivideCurve(Curve=cir_2, Count=number_slider, Kinks=False)  # -> Points, Tangents, Parameters
offset = OffsetCurve(Curve=cir_2, Distance="75", Corners=1)
crv_cp = CurveClosestPoint(Point=divide.Points, Curve=offset)  # -> Point, Parameter, Distance
planar = Planar(Curve=cir_2)  # -> Planar, Plane, Deviation
rotate = Rotate(Geometry=crv_cp.Point, Angle=degrees(division), Plane=planar.Plane)  # -> Geometry, Transform
weave = Weave(Pattern=panel, Stream0=divide.Points, Stream1=rotate.Geometry, NullGaps=False)
rotate_2 = Rotate(Geometry=weave, Angle=degrees(Slider(142, range=0..360)), Plane=planar.Plane)  # -> Geometry, Transform
pline = PolyLine(Vertices=rotate_2.Geometry, Closed=invert(False))
list_item = ListItem(List=move.Geometry, Index=0, Wrap=True)
range = Range(Domain=Domain(0, 1), Steps=subtraction)
offset_2 = OffsetCurve(Curve=cir, Distance=Slider(300, range=50..300), Corners=1)
graph_mapper = GraphMapper(
    range,
    x0=0,
    x1=1,
    y0=0,
    y1=1,
    A=1,
    B=0,
    container_name="Linear",
    Graph_x0=0.25,
    Graph_x1=0.75,
    Graph_y0=0.25,
    Graph_y1=0.75)
graft = GraftTree(Tree=offset_2, IncludeEmptyLists=True, IncludeNullItems=True)
graft_2 = GraftTree(Tree=pline, IncludeEmptyLists=True, IncludeNullItems=True)
graft_3 = GraftTree(Tree=cir, IncludeEmptyLists=True, IncludeNullItems=True)
construct_domain = ConstructDomain(DomainStart="1", DomainEnd=Slider(1, range=0..10))
bounds = Bounds(Numbers=graph_mapper)
offset_3 = OffsetCurve(Curve=graft, Distance="-150", Corners=1)
offset_4 = OffsetCurve(Curve=graft, Distance="-75", Corners=1)
divlength = DivideLength(Curve=graft, Length="100")  # -> Points, Tangents, Parameters
number_slider_2 = Slider(4, range=3..8)
remap_numbers = RemapNumbers(Value=graph_mapper, Source=bounds, Target=construct_domain)  # -> Mapped, Clipped
scale = Scale(Geometry=move.Geometry, Center=list_item, Factor=remap_numbers.Mapped)  # -> Geometry, Transform
dispatch = Dispatch(List=divlength.Points, DispatchPattern=[True, False])  # -> ListA, ListB
crv_cp_2 = CurveClosestPoint(Point=divlength.Points, Curve=offset_4)  # -> Point, Parameter, Distance
crv_cp_3 = CurveClosestPoint(Point=divlength.Points, Curve=offset_3)  # -> Point, Parameter, Distance
addition = Addition(A=dispatch.ListA, B=dispatch.ListB)
divide_2 = DivideCurve(Curve=graft_3, Count=number_slider_2, Kinks=False)  # -> Points, Tangents, Parameters
planar_2 = Planar(Curve=offset)  # -> Planar, Plane, Deviation
divide_3 = DivideCurve(Curve=offset, Count=number_slider_2, Kinks=False)  # -> Points, Tangents, Parameters
list_length_2 = ListLength(List=scale.Geometry)
division_2 = Division(A=addition, B="2")
panel_2 = Panel("""2
1
0
1
2""")
shatter = Shatter(Curve=offset, Parameters=divide_3.Parameters)
shatter_2 = Shatter(Curve=graft_3, Parameters=divide_2.Parameters)
subtraction_2 = Subtraction(A=list_length_2, B="1")
weave_2 = Weave(Pattern=panel_2, Stream0=division_2, Stream1=crv_cp_2.Point, Stream2=crv_cp_3.Point, NullGaps=False)
item = ListItem(List=shatter_2, Index="0", Wrap=True)
item_2 = ListItem(List=shatter, Index="0", Wrap=True)
range_2 = Range(Domain=Domain(0, 1), Steps=subtraction_2)
pline_2 = PolyLine(Vertices=weave_2, Closed=invert(False))
end = EndPoints(Curve=item)  # -> Start, End
end_2 = EndPoints(Curve=item_2)  # -> Start, End
pi = Pi(Factor=1)
lng = ListLength(List=flatten(pline_2))
lng_2 = ListLength(List=flatten(graft_2))
ln = Line(StartPoint=end.Start, EndPoint=end_2.Start)
ln_2 = Line(StartPoint=end.End, EndPoint=end_2.End)
graph_mapper_2 = GraphMapper(
    range_2,
    x0=0,
    x1=1,
    y0=0,
    y1=1,
    A=1,
    B=0,
    container_name="Linear",
    Graph_x0=0.25,
    Graph_x1=0.75,
    Graph_y0=0.25,
    Graph_y1=0.75)
panel_3 = Panel("""0
1
2
3""")
len = Length(Curve=ln_2)
multiplication_2 = Multiplication(A=pi, B=Slider(25.29, range=0..30))
series = Series(Start="0", Step="150", Count=lng)
series_2 = Series(Start="0", Step="150", Count=lng_2)
weave_3 = Weave(Pattern=panel_3, Stream0=item, Stream1=ln, Stream2=ln_2, Stream3=item_2, NullGaps=False)
division_3 = Division(A=len, B=Slider(14, range=5..30))
Z = UnitZ(Factor=series)
subtraction_3 = Subtraction(A="150", B=Slider(10, range=3..20))
Z_2 = UnitZ(Factor=series_2)
join = JoinCurves(Curves=weave_3, Preserve=False)
construct_domain_2 = ConstructDomain(DomainStart=0, DomainEnd=multiplication_2)
bounds_2 = Bounds(Numbers=graph_mapper_2)
neg = Negative(Value=division_3)
move_2 = Move(Geometry=pline_2, Motion=graft(Z))  # -> Geometry, Transform
move_3 = Move(Geometry=graft_2, Motion=graft(Z_2))  # -> Geometry, Transform
multiplication_3 = Multiplication(A="150", B="2")
offset_5 = OffsetCurve(Curve=join, Distance=neg, Corners=1)
remap_numbers_2 = RemapNumbers(Value=graph_mapper_2, Source=bounds_2, Target=construct_domain_2)  # -> Mapped, Clipped
boundary = BoundarySurfaces(Edges=move_2.Geometry)
Z_3 = UnitZ(Factor=subtraction_3)
boundary_2 = BoundarySurfaces(Edges=move_3.Geometry)
Z_4 = UnitZ(Factor=multiplication_3)
dom = ConstructDomain(DomainStart="0", DomainEnd="360")
extr = Extrude(Base=boundary, Direction=Z_3)
range_3 = Range(Domain=dom, Steps=number_slider_2)
extr_2 = Extrude(Base=boundary_2, Direction=Z_4)
rotate_3 = Rotate(Geometry=offset_5, Angle=degrees(range_3), Plane=planar_2.Plane)  # -> Geometry, Transform
lng_3 = ListLength(List=flatten(planar_2.Plane))
rotate_4 = Rotate(Geometry=scale.Geometry, Angle=remap_numbers_2.Mapped, Plane=PlaneXY(0, 0, 0))  # -> Geometry, Transform
random = Random(Range=dom, Number=lng_3, Seed=Slider(27, range=0..100))  # -> graft(Random)
sunion = SolidUnion(Breps=extr)
rotate_5 = Rotate(Geometry=rotate_3.Geometry, Angle=degrees(random), Plane=planar_2.Plane)  # -> Geometry, Transform
interpolate = Interpolate(Vertices=rotate_4.Geometry, Degree=3, Periodic=False, KnotStyle=1)  # -> Curve, Length, Domain
panel_4 = Panel(sunion)
series_3 = Series(Start="0", Step="150", Count=lng_3)
point_list = PointList(Points=rotate_4.Geometry, Size=Slider(8, range=0..100))
pipe = Pipe(Curve=interpolate.Curve, Radius=Slider(8, range=0..100), Caps=0)
Z_5 = UnitZ(Factor=series_3)
move_4 = Move(Geometry=rotate_5.Geometry, Motion=graft(Z_5))  # -> Geometry, Transform
boundary_3 = BoundarySurfaces(Edges=move_4.Geometry)
Z_6 = UnitZ(Factor=Slider(300, range=0..300))
extr_3 = Extrude(Base=boundary_3, Direction=Z_6)
offset_curve = OffsetCurve(Curve=interpolate.Curve, Distance=Slider(6, range=0..10), Corners=1)
sdiff = SolidDifference(BrepsA=extr, BrepsB=extr_3)
divide_curve_2 = DivideCurve(Curve=offset_curve, Count=Slider(100, range=0..100), Kinks=False)  # -> Points, Tangents, Parameters
offset_6 = OffsetCurve(Curve=interpolate.Curve, Distance=Slider(3, range=0..100), Corners=1)
panel_5 = Panel("""0
100""")
panel_6 = Panel("""0
100""")
loft = Loft(
    Curves=flatten([offset_6, interpolate.Curve]),
    Options={Adjust=False, Closed=False, LoftEnds=0, LoftSimp=0, LoftType=0, Rebuild=10, Refit=0.01})
list_item_2 = ListItem(List=rotate_4.Geometry, Index=panel_5, Wrap=True)
point_list_2 = PointList(Points=divide_curve_2.Points, Size=Slider(8, range=0..100))
list_item_3 = ListItem(List=divide_curve_2.Points, Index=panel_6, Wrap=True)
unit_z = UnitZ(Factor=Slider(12, range=0..100))
line = Line(StartPoint=list_item_2, EndPoint=list_item_3)
extrude = Extrude(Base=loft, Direction=unit_z)
merge = Merge(Data1=flatten(line), Data3=flatten(rotate_4.Geometry))
scale_2 = Scale(Geometry=extrude, Center=Point(0, 0, 0), Factor=Slider(15, range=10..100))  # -> Geometry, Transform
boundary_surfaces = BoundarySurfaces(Edges=merge)
