# Grasshopper definition Week 7 - Kangaroo.ghx (Grasshopper 1.0.8)
# plug-ins: Kangaroo2 Components

mesh_plane = MeshPlane(Boundary={Plane=PlaneXY(0, 0, 0), Size=Domain2(u=-10..10, v=-10..10)}, WidthCount=20, HeightCount=20)  # -> Mesh, Area
nakedvertices = NakedVertices(Mesh=mesh_plane.Mesh)  # -> ClothedIndex, NakedIndex, ClothedPts, NakedPts
deconstruct_mesh = DeconstructMesh(Mesh=mesh_plane.Mesh)  # -> Vertices, Faces, Colours, Normals
point = Point([<point referenced from the Rhino model> x5])
face_boundaries = FaceBoundaries(Mesh=mesh_plane.Mesh)
closest_point = ClosestPoint(Point=point, Cloud=deconstruct_mesh.Vertices)  # -> ClosestPoint, CPIndex, Distance
edgelengths = EdgeLengths(Mesh=mesh_plane.Mesh, LengthFactor=Slider(1, range=0..1), Strength=Slider(10, range=0..10))
load = Load(Point=deconstruct_mesh.Vertices, ForceVector=Vector(0, 0, 1), Weighting=1)
anchor = Anchor(Point=closest_point.ClosestPoint, Strength=10000)
pressure = Pressure(M=mesh_plane.Mesh, Strength=1)
merge = Merge(Data1=edgelengths, Data2=anchor, Data3=pressure)
stepsolver = StepSolver(
    GoalObjects=flatten(merge),
    Tolerance=0.0001,
    Momentum=False,
    Damping=0.99,
    SubIterations="1",
    Animate=Slider(98, range=0..100))  # -> I, V, O
solver = Solver(GoalObjects=merge, Reset=Button(), Threshold=1e-15, Tolerance=0.0001, On=Toggle(True))  # -> I, V, O
