# Grasshopper definition Week 7 - Mesh.ghx (Grasshopper 1.0.8)
# plug-ins: Human

point = Point()
dynamic_geometry_pipeline = DynamicGeometryPipeline(
    LayerFilter="Default",
    TypeFilter="Point",
    NameFilter="*",
    GroupByLayer=False,
    GroupByType=False,
    IncludeHidden=True,
    IncludeLocked=True,
    enableFullPath=False,
    listenToAttributes=True)
delaunay_mesh = DelaunayMesh(Points=point, Plane=PlaneXY(0, 0, 0))
delaunay_mesh_2 = DelaunayMesh(Points=dynamic_geometry_pipeline, Plane=PlaneXY(0, 0, 0))
face_boundaries = FaceBoundaries(Mesh=delaunay_mesh)
explode = Explode(Curve=face_boundaries, Recursive=True)  # -> Segments, Vertices
circle_fit = CircleFit(Points=explode.Vertices)  # -> Circle, Radius, Deviation
