# Grasshopper definition Week 8 - Redback Trial.ghx (Grasshopper 1.0.8)
# plug-ins: Redback-Beta.GH

panel = Panel("""Default
Layer 01
Layer 02""")
query_model_objects = QueryModelObjects(Layer=panel, Locked=True, Hidden=True, AutoUpdateState=True)
query_viewports = QueryViewports(AutoUpdateState=True)
cylinder = Cylinder(Base=PlaneXY(0, 0, 0), Radius=0.5, Length=1)
clean_tree = CleanTree(RemoveNulls=True, RemoveInvalid=True, RemoveEmpty=True, Tree=query_model_objects)
list_item = ListItem(List=query_viewports, Index=0, Wrap=True)
scale = Scale(Geometry=cylinder, Center=Point(0, 0, 0), Factor=0.5)  # -> Geometry, Transform
model_object = ModelObject(Object=clean_tree)  # -> Object, Geometry, Name, Layer, Visibility, Display, Drafting, Render
view = View(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, ViewSource=1)
model_layer = ModelLayer(Layer=model_object.Layer)  # -> Layer, Name, Hidden, Locked, DisplayColour, Material, Linetype
make2d = Make2D(Geometry=scale.Geometry, View=view, TangentEdges=False, TangentSeams=False, AutoComputeMake2D=False)  # -> VisibleCurves, VisibleIndex, VisibleType, HiddenCurves, HiddenIndex, HiddenType
curve = Curve(model_object.Geometry)
graft_tree = GraftTree(Tree=model_layer.Name, IncludeEmptyLists=True, IncludeNullItems=True)
construct_point = ConstructPoint(XCoordinate=0, YCoordinate=0, ZCoordinate=0)
create_json = CreateJSON(Keys="layer", Values=graft_tree)
panel_2 = Panel(curve)
surface = Surface(<surface referenced from the Rhino model>)
panel_3 = Panel("420,297")
curve_to_polyline = CurveToPolyline(Curve=curve, ToleranceDistance="0.01", ToleranceAngle=0)  # -> Polyline, Segments
panel_4 = Panel(model_layer.Name)
list_item_2 = ListItem(List=model_layer.Name, Index=0, Wrap=True)
evaluate_surface = EvaluateSurface(Surface=surface, Point=construct_point)  # -> Point, Normal, UDirection, VDirection, Frame
unflatten_tree = UnflattenTree(Tree=create_json, Guide=curve_to_polyline.Segments)
geo2arch = Geo2Arch(Geometry=flatten(make2d.VisibleCurves), Properties=flatten("{}"))
xy_plane = XYPlane(Origin=Point(0, 0, 0))
panel_5 = Panel("""*{
stroke: #ff00b4;
stroke-width: 0.2mm;
fill: none;
stroke-dasharray: 1mm 0.5mm;
stroke-linecap: round;
stroke-linejoin: round
}
[layer="Default"] {
stroke-width: 0.5mm;
}
[layer="Layer 01"]{
stroke-width: 0.1mm;
}
[layer="Layer 02"]{
stroke-width: 0.1mm;
stroke-dasharray: 2mm 0.5mm;
}""")
panel_6 = Panel(unflatten_tree)
bounding_box = BoundingBox(Content=surface, Plane=evaluate_surface.Frame)  # -> Box, Box_2
svg_layout = SVGLayout(Plane=xy_plane, Dimensions="A3 (L)", Scale="1:100", Location=Toggle(True))  # -> L, R
geo2arch_2 = Geo2Arch(Geometry=flatten(curve_to_polyline.Polyline), Properties=flatten(unflatten_tree))
relative_path = RelativePath(Path=Toggle(False), RelativePath="svgOutput\make2ddemo.svg")  # -> FullPath, Directory, FileName
svg_generator = SVGGenerator(JO=geo2arch, LA=svg_layout.L, CSS=panel_5)
mergearchjson = MergeArchJSON(AJ=[geo2arch_2, geo2arch])
deconstruct_box = DeconstructBox(Box=bounding_box.Box)  # -> Plane, X, Y, Z
panel_7 = Panel(svg_layout.L)
panel_8 = Panel("C:\Users\fwen4818\Pictures\Screenshots\Screenshot 2024-09-16 120733.png")
panel_9 = Panel("C:\Users\fwen4818\Documents\Enscape")
write_file = WriteFile(Run=Toggle(True), Content=svg_generator, FileDirectory=relative_path.Directory, FileName=relative_path.FileName)
panel_10 = Panel(create_json)
rectangle = Rectangle(Plane=deconstruct_box.Plane, XSize=deconstruct_box.X, YSize=deconstruct_box.Y, Radius=0)  # -> Rectangle, Length
svg_generator_2 = SVGGenerator(JO=geo2arch_2, LA=svg_layout.L, CSS=panel_5)
boolean_toggle = BooleanToggle(False)
replace_text = ReplaceText(Text="svgOutput\svglayerdemo_#.svg", Find="#", Replace=list_item_2, RecursiveReplace=False)
image_object = ImageObject(RE=rectangle.Rectangle, ImagePath=panel_8)
relative_path_2 = RelativePath(Path=boolean_toggle, RelativePath=replace_text)  # -> FullPath, Directory, FileName
panel_11 = Panel(replace_text)
geo2arch_3 = Geo2Arch(Geometry=flatten(image_object), Properties=flatten("{}"))
panel_12 = Panel(relative_path_2.FullPath)
write_file_2 = WriteFile(Run=Toggle(True), Content=svg_generator_2, FileDirectory=relative_path_2.Directory, FileName=relative_path_2.FileName)
panel_13 = Panel(write_file_2)
svg_generator_3 = SVGGenerator(JO=geo2arch_3, LA=svg_layout.L)
relative_path_3 = RelativePath(Path=boolean_toggle, RelativePath="svgOutput\imagedemo.svg")  # -> FullPath, Directory, FileName
write_file_3 = WriteFile(Run=Toggle(True), Content=svg_generator_3, FileDirectory=relative_path_3.Directory, FileName=relative_path_3.FileName)
